# Dynamo graph [Ver01.08.05a]仮設BIM効率化システム.dyn "0322削除前[Ver01.08.05a]仮設BIM効率化システム" (Dynamo 2.3.0.5885)

モデル線分選択 = DSModelElementSelection()  # nothing selected; graph input
watch = Watch(モデル線分選択)
getLocation = Element.GetLocation(element=watch)
startPoint = Curve.StartPoint(curve=getLocation)
X = Point.X(point=startPoint)
Y = Point.Y(point=startPoint)
direction = Line.Direction(line=getLocation)
origin = Point.Origin()
設定不要 = DoubleInput(1)
設定不要_2 = DoubleInput(0)
設定不要_3 = DoubleInput(0)
byCoordinates = Point.ByCoordinates(x=設定不要, y=設定不要_2, z=設定不要_3, lacing=CrossProduct)
byStartPointEndPoint = Line.ByStartPointEndPoint(startPoint=origin, endPoint=byCoordinates)
direction_2 = Line.Direction(line=byStartPointEndPoint)
angleWithVector = Vector.AngleWithVector(vector=direction, otherVector=direction_2)
n10_共通_足場最下段レベル = DoubleInput(200)  # "10.(共通) 足場最下段レベル（敷板35ジャッキ初期値165mmの直上レベル）"; graph input
watch_2 = Watch(n10_共通_足場最下段レベル)  # "2."
n9_共通_足場目標高さ_建物高さ_項目31_で必要出寸法を設定 = DoubleInput(5000)  # "9.(共通) 足場目標高さ : 建物高さ (項目31.で必要出寸法を設定)"; graph input
watch_3 = Watch(n9_共通_足場目標高さ_建物高さ_項目31_で必要出寸法を設定)  # "1."
n14_共通_縦枠高さ_ex_515_939_1244_1725 = DoubleInput(1725)  # "14.(共通) 縦枠高さ（ex,515,939,1244,1725)"; graph input
n29 = Watch(n14_共通_縦枠高さ_ex_515_939_1244_1725)  # "29"
COUNTZ = Watch(n29)
n15_共通_枠幅_ex_610_914_1219 = DoubleInput(914)  # "15.(共通) 枠幅（ex,610,914,1219）"; graph input
n27 = Watch(n15_共通_枠幅_ex_610_914_1219)  # "27"
n38_共通_family入替え = BoolSelector(true)  # "38.(共通) FAMILY入替え: アルインコ枠組み足場FAMILYを使用する"; graph input
n30 = Watch(n38_共通_family入替え)  # "30"
n39_共通_family入替え_iq足場familyを使用する = BoolSelector(false)  # "39.(共通) FAMILY入替え: IQ足場FAMILYを使用する"; graph input
n30_2 = Watch(n39_共通_family入替え_iq足場familyを使用する)  # "30"
n40_共通_family入替え = BoolSelector(false)  # "40.(共通) FAMILY入替え: アルバトロス足場FAMILYを使用する"; graph input
n30_3 = Watch(n40_共通_family入替え)  # "30"
選択_main_python_script = Python(IN[0]=n27, IN[1]=n29, IN[2]=n30, IN[3]=n30_2, IN[4]=n30_3)
# ---------- 選択_main_python_script.python (1328 lines) ----------
# Python のサポートを有効にして DesignScript ライブラリをロード
#import clr
#import System
import math
# このノードへの入力は、リスト形式で IN 変数に格納されます。
dataEnteringNode = IN
waku = IN[0]#枠幅
saikadan = IN[1] # 
inchiashiba = IN[2] #インチ足場 ###################################################################izumi
iqashiba = IN[3] #IQ足場　###################################################################izumi
arubatorosu = IN[4] #アルバトロス　###################################################################mizumoto
# この行の下にコードを配置します
#
#浮動小数点処理　0または1
waku = round(waku,1)
saikadan = round(saikadan,1)
#
waku = math.floor(waku)
saikadan = math.floor(saikadan)

dsd0 = ""
dsd1 = ""
dsd2 = ""
dsd3 = ""
dsd4 = ""
dsd5 = ""
dsd6 = ""
dsd7 = ""
dsd8 = ""

if iqashiba == 88 and inchiashiba == 88 and arubatorosu == 88 : ###################ルーチン飛ばし################################################izumi
     #枠幅
     outlist1 = 0
     if waku <= 450:
          outlist1 = 450
     elif waku <= 600:
          outlist1 = 600
     elif waku <= 610:
          outlist1 = 610
     elif waku <= 900:
          outlist1 = 900
     elif waku <= 914:
          outlist1 = 914
     elif waku <= 1200:
          outlist1 = 1200
     elif waku <= 1219:
          outlist1 = 1219
     else:
          outlist1 = 900
     #枠高さ
     outlist2 = 0
     if saikadan <= 1:
          outlist2 = 1700
     elif saikadan <= 400:
          outlist2 = 400
     elif saikadan <= 515:
          outlist2 = 515
     elif saikadan <= 600:
          outlist2 = 600
     elif saikadan <= 900:
          outlist2 = 900
     elif saikadan <= 939:
          outlist2 = 939
     elif saikadan <= 1200:
          outlist2 = 1200
     elif saikadan <= 1244:
          outlist2 = 1244
     elif saikadan <= 1700:
          outlist2 = 1700
     elif saikadan <= 1725:
          outlist2 = 1725
     else:
          outlist2 = 1700
     #振分け
     if outlist2 == 1700:#枠高さ
          if outlist1 == 450:
               dsd0 = "SM足場簡易枠"
               dsd1 = "SM0418"
               dsd2 = "SM0415"
               dsd3 = "SM0412"
               dsd4 = "SM0409"
               dsd5 = "SM0406"
               dsd6 = "SM足場 調整スパン"
               dsd7 = "SM04"
               dsd8 = "SM04"
          elif outlist1 == 600:
               dsd0 = "SM足場簡易枠"
               dsd1 = "SM0618"
               dsd2 = "SM0615"
               dsd3 = "SM0612"
               dsd4 = "SM0609"
               dsd5 = "SM0606"
               dsd6 = "SM足場 調整スパン"
               dsd7 = "SM06"
               dsd8 = "SM06"
          elif outlist1 == 900:
               dsd0 = "SM足場標準枠 拡幅対応"
               dsd1 = "SM0918"
               dsd2 = "SM0915"
               dsd3 = "SM0912"
               dsd4 = "SM0909"
               dsd5 = "SM0906"
               dsd6 = "SM足場 調整スパン"
               dsd7 = "SM09"
               dsd8 = "SM09"
          elif outlist1 == 1200:
               dsd0 = "SM足場標準枠 拡幅対応"
               dsd1 = "SM1218"
               dsd2 = "SM1215"
               dsd3 = "SM1212"
               dsd4 = "SM1209"
               dsd5 = "SM1206"
               dsd6 = "SM足場 調整スパン"
               dsd7 = "SM12"
               dsd8 = "SM12"
          else:
               dsd0 = "SM足場標準枠 拡幅対応"
               dsd1 = "SM0918"
               dsd2 = "SM0915"
               dsd3 = "SM0912"
               dsd4 = "SM0909"
               dsd5 = "SM0906"
               dsd6 = "SM足場 調整スパン"
               dsd7 = "SM09"
               dsd8 = "SM09"
     else:
          if outlist2 == 400:#枠高さ
               if outlist1 == 600:#枠幅
                    dsd0 = "SM足場調整枠"
                    dsd1 = "SM0618_H400"
                    dsd2 = "SM0615_H400"
                    dsd3 = "SM0612_H400"
                    dsd4 = "SM0609_H400"
                    dsd5 = "SM0606_H400"
                    dsd6 = "SM足場 調整スパン"
                    dsd7 = "SM06 H400"
                    dsd8 = "SM06 H400"
               elif outlist1 == 900:#枠幅
                    dsd0 = "SM足場調整枠"
                    dsd1 = "SM0918_H400"
                    dsd2 = "SM0915_H400"
                    dsd3 = "SM0912_H400"
                    dsd4 = "SM0909_H400"
                    dsd5 = "SM0906_H400"
                    dsd6 = "SM足場 調整スパン"
                    dsd7 = "SM09 H400"
                    dsd8 = "SM09 H400"
               elif outlist1 == 1200:#枠幅
                    dsd0 = "SM足場調整枠"
                    dsd1 = "SM1218_H400"
                    dsd2 = "SM1215_H400"
                    dsd3 = "SM1212_H400"
                    dsd4 = "SM1209_H400"
                    dsd5 = "SM1206_H400"
                    dsd6 = "SM足場 調整スパン"
                    dsd7 = "SM12 H400"
                    dsd8 = "SM12 H400"
               else:
                    dsd0 = "SM足場調整枠"
                    dsd1 = "SM0918_H400"
                    dsd2 = "SM0915_H400"
                    dsd3 = "SM0912_H400"
                    dsd4 = "SM0909_H400"
                    dsd5 = "SM0906_H400"
                    dsd6 = "SM足場 調整スパン"
                    dsd7 = "SM09 H400"
                    dsd8 = "SM09 H400"
          elif outlist2 == 600:#枠高さ
               if outlist1 == 600:#枠幅
                    dsd0 = "SM足場調整枠"
                    dsd1 = "SM0618_H600"
                    dsd2 = "SM0615_H600"
                    dsd3 = "SM0612_H600"
                    dsd4 = "SM0609_H600"
                    dsd5 = "SM0606_H600"
                    dsd6 = "SM足場 調整スパン"
                    dsd7 = "SM06 H600"
                    dsd8 = "SM06 H600"
               elif outlist1 == 900:#枠幅
                    dsd0 = "SM足場調整枠"
                    dsd1 = "SM0918_H600"
                    dsd2 = "SM0915_H600"
                    dsd3 = "SM0912_H600"
                    dsd4 = "SM0909_H600"
                    dsd5 = "SM0906_H600"
                    dsd6 = "SM足場 調整スパン"
                    dsd7 = "SM09 H600"
                    dsd8 = "SM09 H600"
               elif outlist1 == 1200:#枠幅
                    dsd0 = "SM足場調整枠"
                    dsd1 = "SM1218_H600"
                    dsd2 = "SM1215_H600"
                    dsd3 = "SM1212_H600"
                    dsd4 = "SM1209_H600"
                    dsd5 = "SM1206_H600"
                    dsd6 = "SM足場 調整スパン"
                    dsd7 = "SM12 H600"
                    dsd8 = "SM12 H600"
               else:
                    dsd0 = "SM足場調整枠"
                    dsd1 = "SM0918_H600"
                    dsd2 = "SM0915_H600"
                    dsd3 = "SM0912_H600"
                    dsd4 = "SM0909_H600"
                    dsd5 = "SM0906_H600"
                    dsd6 = "SM足場 調整スパン"
                    dsd7 = "SM09 H600"
                    dsd8 = "SM09 H600"
          elif outlist2 == 900:#枠高さ
               if outlist1 == 600:#枠幅
                    dsd0 = "SM足場調整枠"
                    dsd1 = "SM0618_H900"
                    dsd2 = "SM0615_H900"
                    dsd3 = "SM0612_H900"
                    dsd4 = "SM0609_H900"
                    dsd5 = "SM0606_H900"
                    dsd6 = "SM足場 調整スパン"
                    dsd7 = "SM06 H900"
                    dsd8 = "SM06 H900"
               elif outlist1 == 900:#枠幅
                    dsd0 = "SM足場調整枠"
                    dsd1 = "SM0918_H900"
                    dsd2 = "SM0915_H900"
                    dsd3 = "SM0912_H900"
                    dsd4 = "SM0909_H900"
                    dsd5 = "SM0906_H900"
                    dsd6 = "SM足場 調整スパン"
                    dsd7 = "SM09 H900"
                    dsd8 = "SM09 H900"
               elif outlist1 == 1200:#枠幅
                    dsd0 = "SM足場調整枠"
                    dsd1 = "SM1218_H900"
                    dsd2 = "SM1215_H900"
                    dsd3 = "SM1212_H900"
                    dsd4 = "SM1209_H900"
                    dsd5 = "SM1206_H900"
                    dsd6 = "SM足場 調整スパン"
                    dsd7 = "SM12 H900"
                    dsd8 = "SM12 H900"
               else:
                    dsd0 = "SM足場調整枠"
                    dsd1 = "SM0918_H900"
                    dsd2 = "SM0915_H900"
                    dsd3 = "SM0912_H900"
                    dsd4 = "SM0909_H900"
                    dsd5 = "SM0906_H900"
                    dsd6 = "SM足場 調整スパン"
                    dsd7 = "SM09 H900"
                    dsd8 = "SM09 H900"
          elif outlist2 == 1200:#枠高さ
               if outlist1 == 600:#枠幅
                    dsd0 = "SM足場調整枠"
                    dsd1 = "SM0618_H1200"
                    dsd2 = "SM0615_H1200"
                    dsd3 = "SM0612_H1200"
                    dsd4 = "SM0609_H1200"
                    dsd5 = "SM0606_H1200"
                    dsd6 = "SM足場 調整スパン"
                    dsd7 = "SM06 H1200"
                    dsd8 = "SM06 H1200"
               elif outlist1 == 900:#枠幅
                    dsd0 = "SM足場調整枠"
                    dsd1 = "SM0918_H1200"
                    dsd2 = "SM0915_H1200"
                    dsd3 = "SM0912_H1200"
                    dsd4 = "SM0909_H1200"
                    dsd5 = "SM0906_H1200"
                    dsd6 = "SM足場 調整スパン"
                    dsd7 = "SM09 H1200"
                    dsd8 = "SM09 H1200"
               elif outlist1 == 1200:#枠幅
                    dsd0 = "SM足場調整枠"
                    dsd1 = "SM1218_H1200"
                    dsd2 = "SM1215_H1200"
                    dsd3 = "SM1212_H1200"
                    dsd4 = "SM1209_H1200"
                    dsd5 = "SM1206_H1200"
                    dsd6 = "SM足場 調整スパン"
                    dsd7 = "SM12 H1200"
                    dsd8 = "SM12 H1200"
               else:
                    dsd0 = "SM足場調整枠"
                    dsd1 = "SM0918_H1200"
                    dsd2 = "SM0915_H1200"
                    dsd3 = "SM0912_H1200"
                    dsd4 = "SM0909_H1200"
                    dsd5 = "SM0906_H1200"
                    dsd6 = "SM足場 調整スパン"
                    dsd7 = "SM09 H1200"
                    dsd8 = "SM09 H1200"
          else:
               dsd0 = "SM足場標準枠 拡幅対応"
               dsd1 = "SM0918"
               dsd2 = "SM0915"
               dsd3 = "SM0912"
               dsd4 = "SM0909"
               dsd5 = "SM0906"
               dsd6 = "SM足場 調整スパン"
               dsd7 = "SM09"
               dsd8 = "SM09"

elif iqashiba == 0 and inchiashiba == 1 and arubatorosu == 0: ###################################################################miwaここから #mizumoto
     #枠幅
     outlist1 = 0
     if waku <= 410:
          outlist1 = 410
     elif waku <= 450:
          outlist1 = 450
     elif waku <= 610:
          outlist1 = 610
     elif waku <= 914:
          outlist1 = 914
     elif waku <= 1219:
          outlist1 = 1219
     else:
          outlist1 = 914
     #枠高さ
     outlist2 = 0
     if saikadan <= 1:
          outlist2 = 1725
     elif saikadan <= 515:
          outlist2 = 515
     elif saikadan <= 939:
          outlist2 = 939
     elif saikadan <= 1244:
          outlist2 = 1244
     elif saikadan <= 1725:
          outlist2 = 1725
     else:
          outlist2 = 1725
     #振分け
     if outlist2 == 1725:#枠高さ
          if outlist1 == 410:
               dsd0 = "アルインコ_枠組足場"
               dsd1 = "A04118_H1725"
               dsd2 = "A04115_H1725"
               dsd3 = "A04112_H1725"
               dsd4 = "A04109_H1725"
               dsd5 = "A04106_H1725"
               dsd6 = "アルインコ_枠組足場 調整スパン"
               dsd7 = "インチ04"
               dsd8 = "インチ04"
          elif outlist1 == 450:
               dsd0 = "アルインコ_枠組足場"
               dsd1 = "A0418_H1725"
               dsd2 = "A0415_H1725"
               dsd3 = "A0412_H1725"
               dsd4 = "A0409_H1725"
               dsd5 = "A0406_H1725"
               dsd6 = "アルインコ_枠組足場 調整スパン"
               dsd7 = "インチ045"
               dsd8 = "インチ045"
          elif outlist1 == 610:
               dsd0 = "アルインコ_枠組足場"
               dsd1 = "A0618_H1725"
               dsd2 = "A0615_H1725"
               dsd3 = "A0612_H1725"
               dsd4 = "A0609_H1725"
               dsd5 = "A0606_H1725"
               dsd6 = "アルインコ_枠組足場 調整スパン"
               dsd7 = "インチ06"
               dsd8 = "インチ06"
          elif outlist1 == 914:
               dsd0 = "アルインコ_枠組足場"
               dsd1 = "A0918_H1725"
               dsd2 = "A0915_H1725"
               dsd3 = "A0912_H1725"
               dsd4 = "A0909_H1725"
               dsd5 = "A0906_H1725"
               dsd6 = "アルインコ_枠組足場 調整スパン"
               dsd7 = "インチ09"
               dsd8 = "インチ09"
          elif outlist1 == 1219:
               dsd0 = "アルインコ_枠組足場"
               dsd1 = "A1218_H1725"
               dsd2 = "A1215_H1725"
               dsd3 = "A1212_H1725"
               dsd4 = "A1209_H1725"
               dsd5 = "A1206_H1725"
               dsd6 = "アルインコ_枠組足場 調整スパン"
               dsd7 = "インチ12"
               dsd8 = "インチ12"
          else:
               dsd0 = "アルインコ_枠組足場"
               dsd1 = "A0918_H1725"
               dsd2 = "A0915_H1725"
               dsd3 = "A0912_H1725"
               dsd4 = "A0909_H1725"
               dsd5 = "A0906_H1725"
               dsd6 = "アルインコ_枠組足場 調整スパン"
               dsd7 = "インチ09"
               dsd8 = "インチ09"
     else:
          if outlist2 == 515:#枠高さ
               if outlist1 == 610:#枠幅
                    dsd0 = "アルインコ_枠組足場 調整枠"
                    dsd1 = "A0618_H515"
                    dsd2 = "A0615_H515"
                    dsd3 = "A0612_H515"
                    dsd4 = "A0609_H515"
                    dsd5 = "A0606_H515"
                    dsd6 = "アルインコ_枠組足場 調整スパン"
                    dsd7 = "インチ06_H515"
                    dsd8 = "インチ06_H515"
               elif outlist1 == 914:#枠幅
                    dsd0 = "アルインコ_枠組足場 調整枠"
                    dsd1 = "A0918_H515"
                    dsd2 = "A0915_H515"
                    dsd3 = "A0912_H515"
                    dsd4 = "A0909_H515"
                    dsd5 = "A0906_H515"
                    dsd6 = "アルインコ_枠組足場 調整スパン"
                    dsd7 = "インチ09_H515"
                    dsd8 = "インチ09_H515"
               elif outlist1 == 1219:#枠幅
                    dsd0 = "アルインコ_枠組足場 調整枠"
                    dsd1 = "A1218_H515"
                    dsd2 = "A1215_H515"
                    dsd3 = "A1212_H515"
                    dsd4 = "A1209_H515"
                    dsd5 = "A1206_H515"
                    dsd6 = "アルインコ_枠組足場 調整スパン"
                    dsd7 = "インチ12_H515"
                    dsd8 = "インチ12_H515"
               else:
                    dsd0 = "アルインコ_枠組足場 調整枠"
                    dsd1 = "A0918_H515"
                    dsd2 = "A0915_H515"
                    dsd3 = "A0912_H515"
                    dsd4 = "A0909_H515"
                    dsd5 = "A0906_H515"
                    dsd6 = "アルインコ_枠組足場 調整スパン"
                    dsd7 = "インチ09_H515"
                    dsd8 = "インチ09_H515"
          elif outlist2 == 939:#枠高さ
               if outlist1 == 610:#枠幅
                    dsd0 = "アルインコ_枠組足場 調整枠"
                    dsd1 = "A0618_H939"
                    dsd2 = "A0615_H939"
                    dsd3 = "A0612_H939"
                    dsd4 = "A0609_H939"
                    dsd5 = "A0606_H939"
                    dsd6 = "アルインコ_枠組足場 調整スパン"
                    dsd7 = "インチ06_H939"
                    dsd8 = "インチ06_H939"
               elif outlist1 == 914:#枠幅
                    dsd0 = "アルインコ_枠組足場 調整枠"
                    dsd1 = "A0918_H939"
                    dsd2 = "A0915_H939"
                    dsd3 = "A0912_H939"
                    dsd4 = "A0909_H939"
                    dsd5 = "A0906_H939"
                    dsd6 = "アルインコ_枠組足場 調整スパン"
                    dsd7 = "インチ09_H939"
                    dsd8 = "インチ09_H939"
               elif outlist1 == 1219:#枠幅
                    dsd0 = "アルインコ_枠組足場 調整枠"
                    dsd1 = "A1218_H939"
                    dsd2 = "A1215_H939"
                    dsd3 = "A1212_H939"
                    dsd4 = "A1209_H939"
                    dsd5 = "A1206_H939"
                    dsd6 = "アルインコ_枠組足場 調整スパン"
                    dsd7 = "インチ12_H939"
                    dsd8 = "インチ12_H939"
               else:
                    dsd0 = "アルインコ_枠組足場 調整枠"
                    dsd1 = "A0918_H939"
                    dsd2 = "A0915_H939"
                    dsd3 = "A0912_H939"
                    dsd4 = "A0909_H939"
                    dsd5 = "A0906_H939"
                    dsd6 = "アルインコ_枠組足場 調整スパン"
                    dsd7 = "インチ09_H939"
                    dsd8 = "インチ09_H939"
          elif outlist2 == 1244:#枠高さ
               if outlist1 == 610:#枠幅
                    dsd0 = "アルインコ_枠組足場 調整枠"
                    dsd1 = "A0618_H1244"
                    dsd2 = "A0615_H1244"
                    dsd3 = "A0612_H1244"
                    dsd4 = "A0609_H1244"
                    dsd5 = "A0606_H1244"
                    dsd6 = "アルインコ_枠組足場 調整スパン"
                    dsd7 = "インチ06_H1244"
                    dsd8 = "インチ06_H1244"
               elif outlist1 == 914:#枠幅
                    dsd0 = "アルインコ_枠組足場 調整枠"
                    dsd1 = "A0918_H1244"
                    dsd2 = "A0915_H1244"
                    dsd3 = "A0912_H1244"
                    dsd4 = "A0909_H1244"
                    dsd5 = "A0906_H1244"
                    dsd6 = "アルインコ_枠組足場 調整スパン"
                    dsd7 = "インチ09_H1244"
                    dsd8 = "インチ09_H1244"
               elif outlist1 == 1219:#枠幅
                    dsd0 = "アルインコ_枠組足場 調整枠"
                    dsd1 = "A1218_H1244"
                    dsd2 = "A1215_H1244"
                    dsd3 = "A1212_H1244"
                    dsd4 = "A1209_H1244"
                    dsd5 = "A1206_H1244"
                    dsd6 = "アルインコ_枠組足場 調整スパン"
                    dsd7 = "インチ12_H1244"
                    dsd8 = "インチ12_H1244"
               else:
                    dsd0 = "アルインコ_枠組足場 調整枠"
                    dsd1 = "A0918_H1244"
                    dsd2 = "A0915_H1244"
                    dsd3 = "A0912_H1244"
                    dsd4 = "A0909_H1244"
                    dsd5 = "A0906_H1244"
                    dsd6 = "アルインコ_枠組足場 調整スパン"
                    dsd7 = "インチ09_H1244"
                    dsd8 = "インチ09_H1244"
          else:
               dsd0 = "アルインコ_枠組足場"
               dsd1 = "A0918_H1725"
               dsd2 = "A0915_H1725"
               dsd3 = "A0912_H1725"
               dsd4 = "A0909_H1725"
               dsd5 = "A0906_H1725"
               dsd6 = "アルインコ_枠組足場 調整スパン"
               dsd7 = "インチ09"
               dsd8 = "インチ09"
               
###################################################################miwaここまで

elif iqashiba == 1 and inchiashiba == 0 and arubatorosu == 0: ###################################################################izumiここから #mizumoto
     #枠幅
     outlist1 = 0
     if waku <= 610:
          outlist1 = 610
     elif waku <= 914:
          outlist1 = 914
     elif waku <= 1107: 
          outlist1 = 1107 
     elif waku <= 1219:
          outlist1 = 1219
     else:
          outlist1 = 914 
     #枠高さ
     outlist2 = 0
     if saikadan <= 1:
          outlist2 = 1900
     elif saikadan <= 1425:
          outlist2 = 1425
     elif saikadan <= 1800:
          outlist2 = 1800
     elif saikadan <= 1900:
          outlist2 = 1900
     else:
          outlist2 = 1900 
     #振分け
     if outlist2 == 1900:#枠高さ
          if outlist1 == 610: #枠幅
               dsd0 = "IQ足場"
               dsd1 = "IQ0618_H1900"
               dsd2 = "IQ0615_H1900"
               dsd3 = "IQ0612_H1900"
               dsd4 = "IQ0609_H1900"
               dsd5 = "IQ0606_H1900"
               dsd6 = "IQ足場 調整スパン"
               dsd7 = "IQ06 H1900"
               dsd8 = "IQ06 H1900"
          elif outlist1 == 914: #枠幅
               dsd0 = "IQ足場"
               dsd1 = "IQ0918_H1900"
               dsd2 = "IQ0915_H1900"
               dsd3 = "IQ0912_H1900"
               dsd4 = "IQ0909_H1900"
               dsd5 = "IQ0906_H1900"
               dsd6 = "IQ足場 調整スパン"
               dsd7 = "IQ09 H1900"
               dsd8 = "IQ09 H1900"
          elif outlist1 == 1107: #枠幅
               dsd0 = "IQ足場"
               dsd1 = "IQ1118_H1900"
               dsd2 = "IQ1115_H1900"
               dsd3 = "IQ1112_H1900"
               dsd4 = "IQ1109_H1900"
               dsd5 = "IQ1106_H1900"
               dsd6 = "IQ足場 調整スパン"
               dsd7 = "IQ11 H1900"
               dsd8 = "IQ11 H1900"
          elif outlist1 == 1219: #枠幅
               dsd0 = "IQ足場"
               dsd1 = "IQ1218_H1900"
               dsd2 = "IQ1215_H1900"
               dsd3 = "IQ1212_H1900"
               dsd4 = "IQ1209_H1900"
               dsd5 = "IQ1206_H1900"
               dsd6 = "IQ足場 調整スパン"
               dsd7 = "IQ12 H1900"
               dsd8 = "IQ12 H1900"
          else:
               dsd0 = "IQ足場"
               dsd1 = "IQ0918_H1900"
               dsd2 = "IQ0915_H1900"
               dsd3 = "IQ0912_H1900"
               dsd4 = "IQ0909_H1900"
               dsd5 = "IQ0906_H1900"
               dsd6 = "IQ足場 調整スパン"
               dsd7 = "IQ09 H1900"
               dsd8 = "IQ09 H1900"
     else:
          if outlist2 == 1425:#枠高さ
               if outlist1 == 610: #枠幅
                    dsd0 = "IQ足場"
                    dsd1 = "IQ0618_H1425"
                    dsd2 = "IQ0615_H1425"
                    dsd3 = "IQ0612_H1425"
                    dsd4 = "IQ0609_H1425"
                    dsd5 = "IQ0606_H1425"
                    dsd6 = "IQ足場 調整スパン"
                    dsd7 = "IQ06 H1425"
                    dsd8 = "IQ06 H1425"
               elif outlist1 == 914: #枠幅
                    dsd0 = "IQ足場"
                    dsd1 = "IQ0918_H1425"
                    dsd2 = "IQ0915_H1425"
                    dsd3 = "IQ0912_H1425"
                    dsd4 = "IQ0909_H1425"
                    dsd5 = "IQ0906_H1425"
                    dsd6 = "IQ足場 調整スパン"
                    dsd7 = "IQ09 H1425"
                    dsd8 = "IQ09 H1425"
               elif outlist1 == 1107: #枠幅
                    dsd0 = "IQ足場"
                    dsd1 = "IQ1118_H1425"
                    dsd2 = "IQ1115_H1425"
                    dsd3 = "IQ1112_H1425"
                    dsd4 = "IQ1109_H1425"
                    dsd5 = "IQ1106_H1425"
                    dsd6 = "IQ足場 調整スパン"
                    dsd7 = "IQ11 H1425"
                    dsd8 = "IQ11 H1425"
               elif outlist1 == 1219: #枠幅
                    dsd0 = "IQ足場"
                    dsd1 = "IQ1218_H1425"
                    dsd2 = "IQ1215_H1425"
                    dsd3 = "IQ1212_H1425"
                    dsd4 = "IQ1209_H1425"
                    dsd5 = "IQ1206_H1425"
                    dsd6 = "IQ足場 調整スパン"
                    dsd7 = "IQ12 H1425"
                    dsd8 = "IQ12 H1425"
               else:
                    dsd0 = "IQ足場"
                    dsd1 = "IQ0918_H1425"
                    dsd2 = "IQ0915_H1425"
                    dsd3 = "IQ0912_H1425"
                    dsd4 = "IQ0909_H1425"
                    dsd5 = "IQ0906_H1425"
                    dsd6 = "IQ足場 調整スパン"
                    dsd7 = "IQ09 H1425"
                    dsd8 = "IQ09 H1425"
          elif outlist2 == 1800:#枠高さ
               if outlist1 == 610: #枠幅
                    dsd0 = "IQ足場調整高さ_H1800"
                    dsd1 = "IQ0618_H1800"
                    dsd2 = "IQ0615_H1800"
                    dsd3 = "IQ0612_H1800"
                    dsd4 = "IQ0609_H1800"
                    dsd5 = "IQ0606_H1800"
                    dsd6 = "IQ足場 調整スパン"
                    dsd7 = "IQ06 H1800"
                    dsd8 = "IQ06 H1800"
               elif outlist1 == 914: #枠幅
                    dsd0 = "IQ足場調整高さ_H1800"
                    dsd1 = "IQ0918_H1800"
                    dsd2 = "IQ0915_H1800"
                    dsd3 = "IQ0912_H1800"
                    dsd4 = "IQ0909_H1800"
                    dsd5 = "IQ0906_H1800"
                    dsd6 = "IQ足場 調整スパン"
                    dsd7 = "IQ09 H1800"
                    dsd8 = "IQ09 H1800"
               elif outlist1 == 1107: #枠幅
                    dsd0 = "IQ足場調整高さ_H1800"
                    dsd1 = "IQ1118_H1800"
                    dsd2 = "IQ1115_H1800"
                    dsd3 = "IQ1112_H1800"
                    dsd4 = "IQ1109_H1800"
                    dsd5 = "IQ1106_H1800"
                    dsd6 = "IQ足場 調整スパン"
                    dsd7 = "IQ11 H1800"
                    dsd8 = "IQ11 H1800"
               elif outlist1 == 1219: #枠幅
                    dsd0 = "IQ足場調整高さ_H1800"
                    dsd1 = "IQ1218_H1800"
                    dsd2 = "IQ1215_H1800"
                    dsd3 = "IQ1212_H1800"
                    dsd4 = "IQ1209_H1800"
                    dsd5 = "IQ1206_H1800"
                    dsd6 = "IQ足場 調整スパン"
                    dsd7 = "IQ12 H1800"
                    dsd8 = "IQ12 H1800"
               else:
                    dsd0 = "IQ足場調整高さ_H1800"
                    dsd1 = "IQ0918_H1800"
                    dsd2 = "IQ0915_H1800"
                    dsd3 = "IQ0912_H1800"
                    dsd4 = "IQ0909_H1800"
                    dsd5 = "IQ0906_H1800"
                    dsd6 = "IQ足場 調整スパン"
                    dsd7 = "IQ09 H1800"
                    dsd8 = "IQ09 H1800"
          else:
               dsd0 = "IQ足場"
               dsd1 = "IQ0918_H1900"
               dsd2 = "IQ0915_H1900"
               dsd3 = "IQ0912_H1900"
               dsd4 = "IQ0909_H1900"
               dsd5 = "IQ0906_H1900"
               dsd6 = "IQ足場 調整スパン"
               dsd7 = "IQ09 H1900"
               dsd8 = "IQ09 H1900"

elif iqashiba == 0 and inchiashiba == 0 and arubatorosu == 1: ###################################################################mizumotoここから
     #枠幅
     outlist1 = 0
     if waku <= 610:
          outlist1 = 610
     elif waku <= 914:
          outlist1 = 914
     elif waku <= 1219:
          outlist1 = 1219
     else:
          outlist1 = 914 
     #枠高さ
     outlist2 = 0
     if saikadan <= 1:
          outlist2 = 1800
     elif saikadan <= 450:
          outlist2 = 450
     elif saikadan <= 675:
          outlist2 = 675
     elif saikadan <= 900:
          outlist2 = 900
     elif saikadan <= 1125:
          outlist2 = 1125
     elif saikadan <= 1350:
          outlist2 = 1350
     elif saikadan <= 1575:
          outlist2 = 1575
     elif saikadan <= 1800:
          outlist2 = 1800
     elif saikadan <= 2025:
          outlist2 = 2025
     else:
          outlist2 = 1800 
     #振分け
     if outlist2 == 1800:#枠高さ
          if outlist1 == 610: #枠幅
               dsd0 = "アルバトロス足場"
               dsd1 = "アルバトロス0618_H1800"
               dsd2 = "アルバトロス0615_H1800"
               dsd3 = "アルバトロス0612_H1800"
               dsd4 = "アルバトロス0609_H1800"
               dsd5 = "アルバトロス0606_H1800"
               dsd6 = "アルバトロス足場 調整スパン"
               dsd7 = "アルバトロス06 H1800"
               dsd8 = "アルバトロス06 H1800"
          elif outlist1 == 914: #枠幅
               dsd0 = "アルバトロス足場"
               dsd1 = "アルバトロス0918_H1800"
               dsd2 = "アルバトロス0915_H1800"
               dsd3 = "アルバトロス0912_H1800"
               dsd4 = "アルバトロス0909_H1800"
               dsd5 = "アルバトロス0906_H1800"
               dsd6 = "アルバトロス足場 調整スパン"
               dsd7 = "アルバトロス09 H1800"
               dsd8 = "アルバトロス09 H1800"
          elif outlist1 == 1219: #枠幅
               dsd0 = "アルバトロス足場"
               dsd1 = "アルバトロス1218_H1800"
               dsd2 = "アルバトロス1215_H1800"
               dsd3 = "アルバトロス1212_H1800"
               dsd4 = "アルバトロス1209_H1800"
               dsd5 = "アルバトロス1206_H1800"
               dsd6 = "アルバトロス足場 調整スパン"
               dsd7 = "アルバトロス12 H1800"
               dsd8 = "アルバトロス12 H1800"
          else:
               dsd0 = "アルバトロス足場"
               dsd1 = "アルバトロス0918_H1800"
               dsd2 = "アルバトロス0915_H1800"
               dsd3 = "アルバトロス0912_H1800"
               dsd4 = "アルバトロス0909_H1800"
               dsd5 = "アルバトロス0906_H1800"
               dsd6 = "アルバトロス足場 調整スパン"
               dsd7 = "アルバトロス09 H1800"
               dsd8 = "アルバトロス09 H1800"
     else:
          if outlist2 == 450:#枠高さ
               if outlist1 == 610: #枠幅
                    dsd0 = "アルバトロス足場"
                    dsd1 = "アルバトロス0618_H450"
                    dsd2 = "アルバトロス0615_H450"
                    dsd3 = "アルバトロス0612_H450"
                    dsd4 = "アルバトロス0609_H450"
                    dsd5 = "アルバトロス0606_H450"
                    dsd6 = "アルバトロス足場 調整スパン"
                    dsd7 = "アルバトロス06 H450"
                    dsd8 = "アルバトロス06 H450"
               elif outlist1 == 914: #枠幅
                    dsd0 = "アルバトロス足場"
                    dsd1 = "アルバトロス0918_H450"
                    dsd2 = "アルバトロス0915_H450"
                    dsd3 = "アルバトロス0912_H450"
                    dsd4 = "アルバトロス0909_H450"
                    dsd5 = "アルバトロス0906_H450"
                    dsd6 = "アルバトロス足場 調整スパン"
                    dsd7 = "アルバトロス09 H450"
                    dsd8 = "アルバトロス09 H450"
               elif outlist1 == 1219: #枠幅
                    dsd0 = "アルバトロス足場"
                    dsd1 = "アルバトロス1218_H450"
                    dsd2 = "アルバトロス1215_H450"
                    dsd3 = "アルバトロス1212_H450"
                    dsd4 = "アルバトロス1209_H450"
                    dsd5 = "アルバトロス1206_H450"
                    dsd6 = "アルバトロス足場 調整スパン"
                    dsd7 = "アルバトロス12 H450"
                    dsd8 = "アルバトロス12 H450"
               else:
                    dsd0 = "アルバトロス足場"
                    dsd1 = "アルバトロス0918_H450"
                    dsd2 = "アルバトロス0915_H450"
                    dsd3 = "アルバトロス0912_H450"
                    dsd4 = "アルバトロス0909_H450"
                    dsd5 = "アルバトロス0906_H450"
                    dsd6 = "アルバトロス足場 調整スパン"
                    dsd7 = "アルバトロス09 H450"
                    dsd8 = "アルバトロス09 H450"
          elif outlist2 == 675:#枠高さ
               if outlist1 == 610: #枠幅
                    dsd0 = "アルバトロス足場"
                    dsd1 = "アルバトロス0618_H675"
                    dsd2 = "アルバトロス0615_H675"
                    dsd3 = "アルバトロス0612_H675"
                    dsd4 = "アルバトロス0609_H675"
                    dsd5 = "アルバトロス0606_H675"
                    dsd6 = "アルバトロス足場 調整スパン"
                    dsd7 = "アルバトロス06 H675"
                    dsd8 = "アルバトロス06 H675"
               elif outlist1 == 914: #枠幅
                    dsd0 = "アルバトロス足場"
                    dsd1 = "アルバトロス0918_H675"
                    dsd2 = "アルバトロス0915_H675"
                    dsd3 = "アルバトロス0912_H675"
                    dsd4 = "アルバトロス0909_H675"
                    dsd5 = "アルバトロス0906_H675"
                    dsd6 = "アルバトロス足場 調整スパン"
                    dsd7 = "アルバトロス09 H675"
                    dsd8 = "アルバトロス09 H675"
               elif outlist1 == 1219: #枠幅
                    dsd0 = "アルバトロス足場"
                    dsd1 = "アルバトロス1218_H675"
                    dsd2 = "アルバトロス1215_H675"
                    dsd3 = "アルバトロス1212_H675"
                    dsd4 = "アルバトロス1209_H675"
                    dsd5 = "アルバトロス1206_H675"
                    dsd6 = "アルバトロス足場 調整スパン"
                    dsd7 = "アルバトロス12 H675"
                    dsd8 = "アルバトロス12 H675"
               else:
                    dsd0 = "アルバトロス足場"
                    dsd1 = "アルバトロス0918_H675"
                    dsd2 = "アルバトロス0915_H675"
                    dsd3 = "アルバトロス0912_H675"
                    dsd4 = "アルバトロス0909_H675"
                    dsd5 = "アルバトロス0906_H675"
                    dsd6 = "アルバトロス足場 調整スパン"
                    dsd7 = "アルバトロス09 H675"
                    dsd8 = "アルバトロス09 H675"
          elif outlist2 == 900:#枠高さ
               if outlist1 == 610: #枠幅
                    dsd0 = "アルバトロス足場"
                    dsd1 = "アルバトロス0618_H900"
                    dsd2 = "アルバトロス0615_H900"
                    dsd3 = "アルバトロス0612_H900"
                    dsd4 = "アルバトロス0609_H900"
                    dsd5 = "アルバトロス0606_H900"
                    dsd6 = "アルバトロス足場 調整スパン"
                    dsd7 = "アルバトロス06 H900"
                    dsd8 = "アルバトロス06 H900"
               elif outlist1 == 914: #枠幅
                    dsd0 = "アルバトロス足場"
                    dsd1 = "アルバトロス0918_H900"
                    dsd2 = "アルバトロス0915_H900"
                    dsd3 = "アルバトロス0912_H900"
                    dsd4 = "アルバトロス0909_H900"
                    dsd5 = "アルバトロス0906_H900"
                    dsd6 = "アルバトロス足場 調整スパン"
                    dsd7 = "アルバトロス09 H900"
                    dsd8 = "アルバトロス09 H900"
               elif outlist1 == 1219: #枠幅
                    dsd0 = "アルバトロス足場"
                    dsd1 = "アルバトロス1218_H900"
                    dsd2 = "アルバトロス1215_H900"
                    dsd3 = "アルバトロス1212_H900"
                    dsd4 = "アルバトロス1209_H900"
                    dsd5 = "アルバトロス1206_H900"
                    dsd6 = "アルバトロス足場 調整スパン"
                    dsd7 = "アルバトロス12 H900"
                    dsd8 = "アルバトロス12 H900"
               else:
                    dsd0 = "アルバトロス足場"
                    dsd1 = "アルバトロス0918_H900"
                    dsd2 = "アルバトロス0915_H900"
                    dsd3 = "アルバトロス0912_H900"
                    dsd4 = "アルバトロス0909_H900"
                    dsd5 = "アルバトロス0906_H900"
                    dsd6 = "アルバトロス足場 調整スパン"
                    dsd7 = "アルバトロス09 H900"
                    dsd8 = "アルバトロス09 H900"
          elif outlist2 == 1125:#枠高さ
               if outlist1 == 610: #枠幅
                    dsd0 = "アルバトロス足場"
                    dsd1 = "アルバトロス0618_H1125"
                    dsd2 = "アルバトロス0615_H1125"
                    dsd3 = "アルバトロス0612_H1125"
                    dsd4 = "アルバトロス0609_H1125"
                    dsd5 = "アルバトロス0606_H1125"
                    dsd6 = "アルバトロス足場 調整スパン"
                    dsd7 = "アルバトロス06 H1125"
                    dsd8 = "アルバトロス06 H1125"
               elif outlist1 == 914: #枠幅
                    dsd0 = "アルバトロス足場"
                    dsd1 = "アルバトロス0918_H1125"
                    dsd2 = "アルバトロス0915_H1125"
                    dsd3 = "アルバトロス0912_H1125"
                    dsd4 = "アルバトロス0909_H1125"
                    dsd5 = "アルバトロス0906_H1125"
                    dsd6 = "アルバトロス足場 調整スパン"
                    dsd7 = "アルバトロス09 H1125"
                    dsd8 = "アルバトロス09 H1125"
               elif outlist1 == 1219: #枠幅
                    dsd0 = "アルバトロス足場"
                    dsd1 = "アルバトロス1218_H1125"
                    dsd2 = "アルバトロス1215_H1125"
                    dsd3 = "アルバトロス1212_H1125"
                    dsd4 = "アルバトロス1209_H1125"
                    dsd5 = "アルバトロス1206_H1125"
                    dsd6 = "アルバトロス足場 調整スパン"
                    dsd7 = "アルバトロス12 H1125"
                    dsd8 = "アルバトロス12 H1125"
               else:
                    dsd0 = "アルバトロス足場"
                    dsd1 = "アルバトロス0918_H1125"
                    dsd2 = "アルバトロス0915_H1125"
                    dsd3 = "アルバトロス0912_H1125"
                    dsd4 = "アルバトロス0909_H1125"
                    dsd5 = "アルバトロス0906_H1125"
                    dsd6 = "アルバトロス足場 調整スパン"
                    dsd7 = "アルバトロス09 H1125"
                    dsd8 = "アルバトロス09 H1125"
          elif outlist2 == 1350:#枠高さ
               if outlist1 == 610: #枠幅
                    dsd0 = "アルバトロス足場"
                    dsd1 = "アルバトロス0618_H1350"
                    dsd2 = "アルバトロス0615_H1350"
                    dsd3 = "アルバトロス0612_H1350"
                    dsd4 = "アルバトロス0609_H1350"
                    dsd5 = "アルバトロス0606_H1350"
                    dsd6 = "アルバトロス足場 調整スパン"
                    dsd7 = "アルバトロス06 H1350"
                    dsd8 = "アルバトロス06 H1350"
               elif outlist1 == 914: #枠幅
                    dsd0 = "アルバトロス足場"
                    dsd1 = "アルバトロス0918_H1350"
                    dsd2 = "アルバトロス0915_H1350"
                    dsd3 = "アルバトロス0912_H1350"
                    dsd4 = "アルバトロス0909_H1350"
                    dsd5 = "アルバトロス0906_H1350"
                    dsd6 = "アルバトロス足場 調整スパン"
                    dsd7 = "アルバトロス09 H1350"
                    dsd8 = "アルバトロス09 H1350"
               elif outlist1 == 1219: #枠幅
                    dsd0 = "アルバトロス足場"
                    dsd1 = "アルバトロス1218_H1350"
                    dsd2 = "アルバトロス1215_H1350"
                    dsd3 = "アルバトロス1212_H1350"
                    dsd4 = "アルバトロス1209_H1350"
                    dsd5 = "アルバトロス1206_H1350"
                    dsd6 = "アルバトロス足場 調整スパン"
                    dsd7 = "アルバトロス12 H1350"
                    dsd8 = "アルバトロス12 H1350"
               else:
                    dsd0 = "アルバトロス足場"
                    dsd1 = "アルバトロス0918_H1350"
                    dsd2 = "アルバトロス0915_H1350"
                    dsd3 = "アルバトロス0912_H1350"
                    dsd4 = "アルバトロス0909_H1350"
                    dsd5 = "アルバトロス0906_H1350"
                    dsd6 = "アルバトロス足場 調整スパン"
                    dsd7 = "アルバトロス09 H1350"
                    dsd8 = "アルバトロス09 H1350"
          elif outlist2 == 1575:#枠高さ
               if outlist1 == 610: #枠幅
                    dsd0 = "アルバトロス足場"
                    dsd1 = "アルバトロス0618_H1575"
                    dsd2 = "アルバトロス0615_H1575"
                    dsd3 = "アルバトロス0612_H1575"
                    dsd4 = "アルバトロス0609_H1575"
                    dsd5 = "アルバトロス0606_H1575"
                    dsd6 = "アルバトロス足場 調整スパン"
                    dsd7 = "アルバトロス06 H1575"
                    dsd8 = "アルバトロス06 H1575"
               elif outlist1 == 914: #枠幅
                    dsd0 = "アルバトロス足場"
                    dsd1 = "アルバトロス0918_H1575"
                    dsd2 = "アルバトロス0915_H1575"
                    dsd3 = "アルバトロス0912_H1575"
                    dsd4 = "アルバトロス0909_H1575"
                    dsd5 = "アルバトロス0906_H1575"
                    dsd6 = "アルバトロス足場 調整スパン"
                    dsd7 = "アルバトロス09 H1575"
                    dsd8 = "アルバトロス09 H1575"
               elif outlist1 == 1219: #枠幅
                    dsd0 = "アルバトロス足場"
                    dsd1 = "アルバトロス1218_H1575"
                    dsd2 = "アルバトロス1215_H1575"
                    dsd3 = "アルバトロス1212_H1575"
                    dsd4 = "アルバトロス1209_H1575"
                    dsd5 = "アルバトロス1206_H1575"
                    dsd6 = "アルバトロス足場 調整スパン"
                    dsd7 = "アルバトロス12 H1575"
                    dsd8 = "アルバトロス12 H1575"
               else:
                    dsd0 = "アルバトロス足場"
                    dsd1 = "アルバトロス0918_H1575"
                    dsd2 = "アルバトロス0915_H1575"
                    dsd3 = "アルバトロス0912_H1575"
                    dsd4 = "アルバトロス0909_H1575"
                    dsd5 = "アルバトロス0906_H1575"
                    dsd6 = "アルバトロス足場 調整スパン"
                    dsd7 = "アルバトロス09 H1575"
                    dsd8 = "アルバトロス09 H1575"
          elif outlist2 == 2025:#枠高さ
               if outlist1 == 610: #枠幅
                    dsd0 = "アルバトロス足場"
                    dsd1 = "アルバトロス0618_H2025"
                    dsd2 = "アルバトロス0615_H2025"
                    dsd3 = "アルバトロス0612_H2025"
                    dsd4 = "アルバトロス0609_H2025"
                    dsd5 = "アルバトロス0606_H2025"
                    dsd6 = "アルバトロス足場 調整スパン"
                    dsd7 = "アルバトロス06 H2025"
                    dsd8 = "アルバトロス06 H2025"
               elif outlist1 == 914: #枠幅
                    dsd0 = "アルバトロス足場"
                    dsd1 = "アルバトロス0918_H2025"
                    dsd2 = "アルバトロス0915_H2025"
                    dsd3 = "アルバトロス0912_H2025"
                    dsd4 = "アルバトロス0909_H2025"
                    dsd5 = "アルバトロス0906_H2025"
                    dsd6 = "アルバトロス足場 調整スパン"
                    dsd7 = "アルバトロス09 H2025"
                    dsd8 = "アルバトロス09 H2025"
               elif outlist1 == 1219: #枠幅
                    dsd0 = "アルバトロス足場"
                    dsd1 = "アルバトロス1218_H2025"
                    dsd2 = "アルバトロス1215_H2025"
                    dsd3 = "アルバトロス1212_H2025"
                    dsd4 = "アルバトロス1209_H2025"
                    dsd5 = "アルバトロス1206_H2025"
                    dsd6 = "アルバトロス足場 調整スパン"
                    dsd7 = "アルバトロス12 H2025"
                    dsd8 = "アルバトロス12 H2025"
               else:
                    dsd0 = "アルバトロス足場"
                    dsd1 = "アルバトロス0918_H2025"
                    dsd2 = "アルバトロス0915_H2025"
                    dsd3 = "アルバトロス0912_H2025"
                    dsd4 = "アルバトロス0909_H2025"
                    dsd5 = "アルバトロス0906_H2025"
                    dsd6 = "アルバトロス足場 調整スパン"
                    dsd7 = "アルバトロス09 H2025"
                    dsd8 = "アルバトロス09 H2025"
          else:
               dsd0 = "アルバトロス足場"
               dsd1 = "アルバトロス0918_H1800"
               dsd2 = "アルバトロス0915_H1800"
               dsd3 = "アルバトロス0912_H1800"
               dsd4 = "アルバトロス0909_H1800"
               dsd5 = "アルバトロス0906_H1800"
               dsd6 = "アルバトロス足場 調整スパン"
               dsd7 = "アルバトロス09 H1800"
               dsd8 = "アルバトロス09 H1800"###################ここまでmizumoto

else:###################mizumoto
     #枠幅
     outlist1 = 0
     if waku <= 410:
          outlist1 = 410
     elif waku <= 450:
          outlist1 = 450
     elif waku <= 610:
          outlist1 = 610
     elif waku <= 914:
          outlist1 = 914
     elif waku <= 1219:
          outlist1 = 1219
     else:
          outlist1 = 914
     #枠高さ
     outlist2 = 0
     if saikadan <= 1:
          outlist2 = 1725
     elif saikadan <= 515:
          outlist2 = 515
     elif saikadan <= 939:
          outlist2 = 939
     elif saikadan <= 1244:
          outlist2 = 1244
     elif saikadan <= 1725:
          outlist2 = 1725
     else:
          outlist2 = 1725
     #振分け
     if outlist2 == 1725:#枠高さ
          if outlist1 == 410:
               dsd0 = "アルインコ_枠組足場"
               dsd1 = "A04118_H1725"
               dsd2 = "A04115_H1725"
               dsd3 = "A04112_H1725"
               dsd4 = "A04109_H1725"
               dsd5 = "A04106_H1725"
               dsd6 = "アルインコ_枠組足場 調整スパン"
               dsd7 = "インチ04"
               dsd8 = "インチ04"
          elif outlist1 == 450:
               dsd0 = "アルインコ_枠組足場"
               dsd1 = "A0418_H1725"
               dsd2 = "A0415_H1725"
               dsd3 = "A0412_H1725"
               dsd4 = "A0409_H1725"
               dsd5 = "A0406_H1725"
               dsd6 = "アルインコ_枠組足場 調整スパン"
               dsd7 = "インチ045"
               dsd8 = "インチ045"
          elif outlist1 == 610:
               dsd0 = "アルインコ_枠組足場"
               dsd1 = "A0618_H1725"
               dsd2 = "A0615_H1725"
               dsd3 = "A0612_H1725"
               dsd4 = "A0609_H1725"
               dsd5 = "A0606_H1725"
               dsd6 = "アルインコ_枠組足場 調整スパン"
               dsd7 = "インチ06"
               dsd8 = "インチ06"
          elif outlist1 == 914:
               dsd0 = "アルインコ_枠組足場"
               dsd1 = "A0918_H1725"
               dsd2 = "A0915_H1725"
               dsd3 = "A0912_H1725"
               dsd4 = "A0909_H1725"
               dsd5 = "A0906_H1725"
               dsd6 = "アルインコ_枠組足場 調整スパン"
               dsd7 = "インチ09"
               dsd8 = "インチ09"
          elif outlist1 == 1219:
               dsd0 = "アルインコ_枠組足場"
               dsd1 = "A1218_H1725"
               dsd2 = "A1215_H1725"
               dsd3 = "A1212_H1725"
               dsd4 = "A1209_H1725"
               dsd5 = "A1206_H1725"
               dsd6 = "アルインコ_枠組足場 調整スパン"
               dsd7 = "インチ12"
               dsd8 = "インチ12"
          else:
               dsd0 = "アルインコ_枠組足場"
               dsd1 = "A0918_H1725"
               dsd2 = "A0915_H1725"
               dsd3 = "A0912_H1725"
               dsd4 = "A0909_H1725"
               dsd5 = "A0906_H1725"
               dsd6 = "アルインコ_枠組足場 調整スパン"
               dsd7 = "インチ09"
               dsd8 = "インチ09"
     else:
          if outlist2 == 515:#枠高さ
               if outlist1 == 610:#枠幅
                    dsd0 = "アルインコ_枠組足場 調整枠"
                    dsd1 = "A0618_H515"
                    dsd2 = "A0615_H515"
                    dsd3 = "A0612_H515"
                    dsd4 = "A0609_H515"
                    dsd5 = "A0606_H515"
                    dsd6 = "アルインコ_枠組足場 調整スパン"
                    dsd7 = "インチ06_H515"
                    dsd8 = "インチ06_H515"
               elif outlist1 == 914:#枠幅
                    dsd0 = "アルインコ_枠組足場 調整枠"
                    dsd1 = "A0918_H515"
                    dsd2 = "A0915_H515"
                    dsd3 = "A0912_H515"
                    dsd4 = "A0909_H515"
                    dsd5 = "A0906_H515"
                    dsd6 = "アルインコ_枠組足場 調整スパン"
                    dsd7 = "インチ09_H515"
                    dsd8 = "インチ09_H515"
               elif outlist1 == 1219:#枠幅
                    dsd0 = "アルインコ_枠組足場 調整枠"
                    dsd1 = "A1218_H515"
                    dsd2 = "A1215_H515"
                    dsd3 = "A1212_H515"
                    dsd4 = "A1209_H515"
                    dsd5 = "A1206_H515"
                    dsd6 = "アルインコ_枠組足場 調整スパン"
                    dsd7 = "インチ12_H515"
                    dsd8 = "インチ12_H515"
               else:
                    dsd0 = "アルインコ_枠組足場 調整枠"
                    dsd1 = "A0918_H515"
                    dsd2 = "A0915_H515"
                    dsd3 = "A0912_H515"
                    dsd4 = "A0909_H515"
                    dsd5 = "A0906_H515"
                    dsd6 = "アルインコ_枠組足場 調整スパン"
                    dsd7 = "インチ09_H515"
                    dsd8 = "インチ09_H515"
          elif outlist2 == 939:#枠高さ
               if outlist1 == 610:#枠幅
                    dsd0 = "アルインコ_枠組足場 調整枠"
                    dsd1 = "A0618_H939"
                    dsd2 = "A0615_H939"
                    dsd3 = "A0612_H939"
                    dsd4 = "A0609_H939"
                    dsd5 = "A0606_H939"
                    dsd6 = "アルインコ_枠組足場 調整スパン"
                    dsd7 = "インチ06_H939"
                    dsd8 = "インチ06_H939"
               elif outlist1 == 914:#枠幅
                    dsd0 = "アルインコ_枠組足場 調整枠"
                    dsd1 = "A0918_H939"
                    dsd2 = "A0915_H939"
                    dsd3 = "A0912_H939"
                    dsd4 = "A0909_H939"
                    dsd5 = "A0906_H939"
                    dsd6 = "アルインコ_枠組足場 調整スパン"
                    dsd7 = "インチ09_H939"
                    dsd8 = "インチ09_H939"
               elif outlist1 == 1219:#枠幅
                    dsd0 = "アルインコ_枠組足場 調整枠"
                    dsd1 = "A1218_H939"
                    dsd2 = "A1215_H939"
                    dsd3 = "A1212_H939"
                    dsd4 = "A1209_H939"
                    dsd5 = "A1206_H939"
                    dsd6 = "アルインコ_枠組足場 調整スパン"
                    dsd7 = "インチ12_H939"
                    dsd8 = "インチ12_H939"
               else:
                    dsd0 = "アルインコ_枠組足場 調整枠"
                    dsd1 = "A0918_H939"
                    dsd2 = "A0915_H939"
                    dsd3 = "A0912_H939"
                    dsd4 = "A0909_H939"
                    dsd5 = "A0906_H939"
                    dsd6 = "アルインコ_枠組足場 調整スパン"
                    dsd7 = "インチ09_H939"
                    dsd8 = "インチ09_H939"
          elif outlist2 == 1244:#枠高さ
               if outlist1 == 610:#枠幅
                    dsd0 = "アルインコ_枠組足場 調整枠"
                    dsd1 = "A0618_H1244"
                    dsd2 = "A0615_H1244"
                    dsd3 = "A0612_H1244"
                    dsd4 = "A0609_H1244"
                    dsd5 = "A0606_H1244"
                    dsd6 = "アルインコ_枠組足場 調整スパン"
                    dsd7 = "インチ06_H1244"
                    dsd8 = "インチ06_H1244"
               elif outlist1 == 914:#枠幅
                    dsd0 = "アルインコ_枠組足場 調整枠"
                    dsd1 = "A0918_H1244"
                    dsd2 = "A0915_H1244"
                    dsd3 = "A0912_H1244"
                    dsd4 = "A0909_H1244"
                    dsd5 = "A0906_H1244"
                    dsd6 = "アルインコ_枠組足場 調整スパン"
                    dsd7 = "インチ09_H1244"
                    dsd8 = "インチ09_H1244"
               elif outlist1 == 1219:#枠幅
                    dsd0 = "アルインコ_枠組足場 調整枠"
                    dsd1 = "A1218_H1244"
                    dsd2 = "A1215_H1244"
                    dsd3 = "A1212_H1244"
                    dsd4 = "A1209_H1244"
                    dsd5 = "A1206_H1244"
                    dsd6 = "アルインコ_枠組足場 調整スパン"
                    dsd7 = "インチ12_H1244"
                    dsd8 = "インチ12_H1244"
               else:
                    dsd0 = "アルインコ_枠組足場 調整枠"
                    dsd1 = "A0918_H1244"
                    dsd2 = "A0915_H1244"
                    dsd3 = "A0912_H1244"
                    dsd4 = "A0909_H1244"
                    dsd5 = "A0906_H1244"
                    dsd6 = "アルインコ_枠組足場 調整スパン"
                    dsd7 = "インチ09_H1244"
                    dsd8 = "インチ09_H1244"
          else:
               dsd0 = "アルインコ_枠組足場"
               dsd1 = "A0918_H1725"
               dsd2 = "A0915_H1725"
               dsd3 = "A0912_H1725"
               dsd4 = "A0909_H1725"
               dsd5 = "A0906_H1725"
               dsd6 = "アルインコ_枠組足場 調整スパン"
               dsd7 = "インチ09"
               dsd8 = "インチ09"



###################################################################izumiここまで
#
# 出力を OUT 変数に割り当てます。
OUT = dsd0,dsd1,dsd2,dsd3,dsd4,dsd5,dsd6,dsd7,dsd8
###end
###end
# ----------------------------------------
枠種類 = CodeBlock(list=選択_main_python_script) { list[0]; list[1]; list[2]; list[3]; list[4]; list[5]; list[6]; list[7]; list[8]; }
枠ネーム = Watch(枠種類.out0)
byFamilyNameAndTypeName = FamilyType.ByFamilyNameAndTypeName(familyName=枠ネーム, typeName=枠種類.out1)
n1800 = Watch(byFamilyNameAndTypeName)  # "1800"
byFamilyNameAndTypeName_2 = FamilyType.ByFamilyNameAndTypeName(familyName=枠ネーム, typeName=枠種類.out2)
n1500 = Watch(byFamilyNameAndTypeName_2)  # "1500"
byFamilyNameAndTypeName_3 = FamilyType.ByFamilyNameAndTypeName(familyName=枠ネーム, typeName=枠種類.out3)
n1200 = Watch(byFamilyNameAndTypeName_3)  # "1200"
byFamilyNameAndTypeName_4 = FamilyType.ByFamilyNameAndTypeName(familyName=枠ネーム, typeName=枠種類.out4)
n900 = Watch(byFamilyNameAndTypeName_4)  # "900"
byFamilyNameAndTypeName_5 = FamilyType.ByFamilyNameAndTypeName(familyName=枠ネーム, typeName=枠種類.out5)
n600 = Watch(byFamilyNameAndTypeName_5)  # "600"
調整スパンネーム = Watch(枠種類.out6)
byFamilyNameAndTypeName_6 = FamilyType.ByFamilyNameAndTypeName(familyName=調整スパンネーム, typeName=枠種類.out7)
調整 = Watch(byFamilyNameAndTypeName_6)
byFamilyNameAndTypeName_7 = FamilyType.ByFamilyNameAndTypeName(familyName=調整スパンネーム, typeName=枠種類.out8)
調整_2 = Watch(byFamilyNameAndTypeName_7)
n16_共通_基本スパン_基本割ex_1829_1524 = DoubleInput(1829)  # "16.(共通) 基本スパン（基本割ex.1829、1524）"; graph input
watch_4 = Watch(n16_共通_基本スパン_基本割ex_1829_1524)  # "16."
n19_手動_始点_セットバック_例_角914なら_914 = DoubleInput(0)  # "19. (手動) ◇◇始点◇◇ セットバック ( 例 : 角914なら -914)"; graph input
watch_5 = Watch(n19_手動_始点_セットバック_例_角914なら_914)  # "4."
n20_手動_始点_スパン_ex_1829_1524 = DoubleInput(1829)  # "20. (手動) ◇◇始点◇◇ スパン (ex.1829,1524)"; graph input
watch_6 = Watch(n20_手動_始点_スパン_ex_1829_1524)  # "5."
n22_手動_終点_セットバック_例_スパン指定なら65_914等 = DoubleInput(0)  # "22.(手動) ◆◆終点◆◆ セットバック ( 例 : スパン指定なら65、-914等、自動=0)"; graph input
watch_7 = Watch(n22_手動_終点_セットバック_例_スパン指定なら65_914等)  # "7."
n23_手動_終点_スパン_1829等_又は_0_自動調整 = DoubleInput(1829)  # "23.(手動) ◆◆終点◆◆ スパン (1829等、又は 0=自動調整、マイナス値=調整なし)"; graph input
watch_8 = Watch(n23_手動_終点_スパン_1829等_又は_0_自動調整)  # "8."
length = Vector.Length(vector=direction)
endPoint = Curve.EndPoint(curve=getLocation)
X_2 = Point.X(point=endPoint)
Y_2 = Point.Y(point=endPoint)
Z = Point.Z(point=startPoint)
n18_手動_始点_端部_1_内_2_左_3_外_0_処理なし_4 = DoubleInput(1)  # "18. (手動) ◇◇始点◇◇ 端部 (1=内 2=左 3=外 0=処理なし 4=処理なし且つクランプ接続 5=処理なし且つ左端部なし)"; graph input
n13 = Watch(n18_手動_始点_端部_1_内_2_左_3_外_0_処理なし_4)  # "13"
n21_手動_終点_端部_1_内_2_右_3_外_0_処理なし_4 = DoubleInput(0)  # "21.(手動) ◆◆終点◆◆ 端部 (1=内 2=右 3=外 0=処理なし 4=処理なし且つクランプ接続 5=処理なし且つ右端部なし)"; graph input
n16 = Watch(n21_手動_終点_端部_1_内_2_右_3_外_0_処理なし_4)  # "16"
n24_共通_外部シート_必要_on_不要_off = BoolSelector(true)  # "24.(共通) 外部シート:必要=ON 不要=OFF"; graph input
n19 = Watch(n24_共通_外部シート_必要_on_不要_off)  # "19"
n25_共通_最下段のシート_必要_on_不要_off = BoolSelector(false)  # "25.(共通) 最下段のシート:必要=ON 不要=OFF"; graph input
n20 = Watch(n25_共通_最下段のシート_必要_on_不要_off)  # "20"
n28_共通_壁つなぎ縦方向スパンピッチ_必要_数値_不要_0 = DoubleInput(2)  # "28.(共通) 壁つなぎ縦方向スパンピッチ : 必要=数値 不要=0"; graph input
n21 = Watch(n28_共通_壁つなぎ縦方向スパンピッチ_必要_数値_不要_0)  # "21"
n29_共通_壁つなぎ横方向スパンピッチ_必要_数値_不要_0 = DoubleInput(2)  # "29.(共通) 壁つなぎ横方向スパンピッチ : 必要=数値 不要=0"; graph input
n22 = Watch(n29_共通_壁つなぎ横方向スパンピッチ_必要_数値_不要_0)  # "22"
n30_共通_落下防止縦方向スパンピッチ_必要_数値_不要_0 = DoubleInput(2)  # "30.(共通) 落下防止縦方向スパンピッチ : 必要=数値 不要=0"; graph input
n23 = Watch(n30_共通_落下防止縦方向スパンピッチ_必要_数値_不要_0)  # "23"
n31_共通_幅木の仕様_必要_1_内側のみ_2_外側のみ_3 = DoubleInput(2)  # "31.(共通) 幅木の仕様 : 必要=1 内側のみ=2 外側のみ=3 不要=0"; graph input
n24 = Watch(n31_共通_幅木の仕様_必要_1_内側のみ_2_外側のみ_3)  # "24"
n32_共通_建物最高部から足場の出寸法_基準900mm = DoubleInput(900)  # "32.(共通) 建物最高部から足場の出寸法(基準900mm)"; graph input
n25 = Watch(n32_共通_建物最高部から足場の出寸法_基準900mm)  # "25"
n11_共通_自動最上段 = BoolSelector(true)  # "11.(共通) 自動最上段"; graph input
n9 = Watch(n11_共通_自動最上段)  # "9"
n12_共通_自動最下段 = BoolSelector(true)  # "12.(共通) 自動最下段"; graph input
n10 = Watch(n12_共通_自動最下段)  # "10"
n13_共通_最下段一列のみ作成 = BoolSelector(false)  # "13.(共通) 最下段一列のみ作成"; graph input
n12 = Watch(n13_共通_最下段一列のみ作成)  # "12"
n43_共通_family選択入替え = BoolSelector(false)  # "43.(共通) FAMILY選択入替え: 下記項目の長さ毎にFAMILYを選択して使用する"; graph input
n30_4 = Watch(n43_共通_family選択入替え)  # "30"
n1800スパン = FamilyTypes("アルバトロス足場_飛散防止メッシュシート:幅0.41高さ1125累計面積0.46")  # "1800スパン"; graph input
n31 = Watch(n1800スパン)  # "31"
n1500スパン = FamilyTypes("アルバトロス足場_飛散防止メッシュシート:幅0.41高さ1125累計面積0.46")  # "1500スパン"; graph input
n32 = Watch(n1500スパン)  # "32"
n1200スパン = FamilyTypes("アルバトロス足場_飛散防止メッシュシート:幅0.41高さ1125累計面積0.46")  # "1200スパン"; graph input
n33 = Watch(n1200スパン)  # "33"
n900スパン = FamilyTypes("アルバトロス足場_飛散防止メッシュシート:幅0.41高さ1125累計面積0.46")  # "900スパン"; graph input
n34 = Watch(n900スパン)  # "34"
n600スパン = FamilyTypes("アルバトロス足場_飛散防止メッシュシート:幅0.41高さ1125累計面積0.46")  # "600スパン"; graph input
n35 = Watch(n600スパン)  # "35"
n600未満300以上_ない場合は600スパン = FamilyTypes("アルバトロス足場_飛散防止メッシュシート:幅0.41高さ1575累計面積0.65")  # "600未満300以上(ない場合は600スパン)"; graph input
n36 = Watch(n600未満300以上_ない場合は600スパン)  # "36"
n300未満_ない場合は同様 = FamilyTypes("アルバトロス足場_飛散防止メッシュシート:幅0.41高さ1575累計面積0.65")  # "300未満(ない場合は同様)"; graph input
n37 = Watch(n300未満_ない場合は同様)  # "37"
n17_共通_調整スパンを使用する_はい_on_いいえ_off = BoolSelector(true)  # "17.(共通) 調整スパンを使用する:はい=ON いいえ=OFF"; graph input
n11 = Watch(n17_共通_調整スパンを使用する_はい_on_いいえ_off)  # "11"
n1_共通_自動パラメータ = BoolSelector(true)  # "1.(共通) 自動パラメータ"; graph input
watch_9 = Watch(n1_共通_自動パラメータ)  # "3."
n2_自動_始点_出隅_on_入隅_off = BoolSelector(true)  # "2.(自動) 始点: 出隅=ON 入隅=OFF"; graph input
watch_10 = Watch(n2_自動_始点_出隅_on_入隅_off)  # "4."
n3_自動_始点_勝_on_負_off = BoolSelector(true)  # "3.(自動) 始点: 勝=ON 負=OFF"; graph input
watch_11 = Watch(n3_自動_始点_勝_on_負_off)  # "5."
n4_自動_終点_出隅_on_入隅_off = BoolSelector(true)  # "4.(自動) 終点: 出隅=ON 入隅=OFF"; graph input
watch_12 = Watch(n4_自動_終点_出隅_on_入隅_off)  # "6."
n5_自動_終点_勝_on_負_off = BoolSelector(true)  # "5.(自動) 終点: 勝=ON 負=OFF"; graph input
watch_13 = Watch(n5_自動_終点_勝_on_負_off)  # "7."
n8_自動_自動クランプ65_基本スパン = BoolSelector(false)  # "8.(自動) 自動クランプ65+基本スパン"; graph input
watch_14 = Watch(n8_自動_自動クランプ65_基本スパン)  # "8."
n6_自動_始点_強制接続 = BoolSelector(false)  # "6.(自動) 始点 強制接続"; graph input
watch_15 = Watch(n6_自動_始点_強制接続)  # "8."
n7_自動_終点_強制接続 = BoolSelector(false)  # "7.(自動) 終点 強制接続"; graph input
watch_16 = Watch(n7_自動_終点_強制接続)  # "8."
n33_共通_足場高さを段数指定 = DoubleInput(0)  # "33.(共通) 足場高さを段数指定(0以外の数字を入れると強制的に段数を優先)"; graph input
n25_2 = Watch(n33_共通_足場高さを段数指定)  # "25"
n26_共通_シート種類_1_メッシュシート_2_垂直ネット_3 = DoubleInput(1)  # "26.(共通) シート種類（1=メッシュシート,2=垂直ネット,3=防炎シート,4=防音シート,5=防音パネル）"; graph input
n28 = Watch(n26_共通_シート種類_1_メッシュシート_2_垂直ネット_3)  # "28"
n27_共通_妻側シート種類_1_メッシュシート_2_垂直ネット = DoubleInput(1)  # "27.(共通) 妻側シート種類（1=メッシュシート,2=垂直ネット,3=防炎シート,4=防音シート,5=防音パネル）"; graph input
n28_2 = Watch(n27_共通_妻側シート種類_1_メッシュシート_2_垂直ネット)  # "28"
n37_共通_family入替え = BoolSelector(false)  # "37.(共通) FAMILY入替え: 単管ブラケット足場FAMILYを使用する"; graph input
n30_5 = Watch(n37_共通_family入替え)  # "30"
n41_共通_family入替え_アサガオfamilyを使用する = BoolSelector(false)  # "41.(共通) FAMILY入替え: アサガオFAMILYを使用する"; graph input
n30_6 = Watch(n41_共通_family入替え_アサガオfamilyを使用する)  # "30"
n42_共通_family入替え = BoolSelector(false)  # "42.(共通) FAMILY入替え: 単管アサガオFAMILYを使用する"; graph input
n30_7 = Watch(n42_共通_family入替え)  # "30"
n34_共通_下部の足場高さを段数指定 = DoubleInput(0)  # "34.(共通) 下部の足場高さを段数指定(0以外の数字を入れると強制的に段数を優先)"; graph input
n25_3 = Watch(n34_共通_下部の足場高さを段数指定)  # "25"
n35_共通_ブラケット長さ = DoubleInput(300)  # "35.(共通) ブラケット長さ"; graph input
n39 = Watch(n35_共通_ブラケット長さ)  # "39"
n36_共通_壁つなぎ長さ = DoubleInput(300)  # "36.(共通) 壁つなぎ長さ"; graph input
n39_2 = Watch(n36_共通_壁つなぎ長さ)  # "39"
python_script = Python(IN[0]=X, IN[1]=Y, IN[2]=angleWithVector, IN[6]=watch_2, IN[7]=watch_3, IN[8]=n29, IN[10]=COUNTZ, IN[11]=n1800, IN[12]=n1500, IN[13]=n1200, IN[14]=n900, IN[15]=n600, IN[16]=調整, IN[17]=調整_2, IN[18]=watch_4, IN[19]=watch_5, IN[20]=watch_6, IN[21]=watch_7, IN[22]=watch_8, IN[23]=length, IN[24]=X_2, IN[25]=Y_2, IN[26]=Z, IN[27]=n13, IN[28]=n16, IN[29]=n19, IN[30]=n20, IN[31]=n21, IN[32]=n22, IN[33]=n23, IN[34]=n24, IN[35]=n25, IN[36]=n9, IN[37]=n10, IN[38]=n12, IN[39]=n30_4, IN[40]=n31, IN[41]=n32, IN[42]=n33, IN[43]=n34, IN[44]=n35, IN[45]=n36, IN[46]=n37, IN[47]=n11, IN[48]=watch_9, IN[49]=watch_10, IN[50]=watch_11, IN[51]=watch_12, IN[52]=watch_13, IN[53]=n27, IN[54]=watch_14, IN[55]=watch_15, IN[56]=watch_16, IN[57]=n25_2, IN[58]=n28, IN[59]=n28_2, IN[60]=n30_5, IN[61]=n30_6, IN[62]=n30_7, IN[63]=n25_3, IN[64]=n30, IN[65]=n30_2, IN[68]=n39, IN[69]=n39_2, IN[70]=n30_3)  # unwired: IN[3], IN[4], IN[5], IN[9], IN[66], IN[67]
# ---------- python_script.python (2021 lines) ----------
#=================================================================================================
#Project Name    : 仮設BIM効率化システム
#File Name       : 01BIM[Ver表記]仮設BIM効率化システム.dyn
#Encoding        : 該当なし
#Creation Date   : 2019.12.5～2020.08.04以降随時
# 
#Copyright c 2019.12.5 HIROYA MIZUMOTO and MANAMI MIWA and CHINATSU IZUMI rights reserved.
#
#This source code or any portion thereof must not be reproduced or used in any manner whatsoever.
#
#Each job is as follows.
#Total designed and writen by HIROYA MIZUMOTO. 
#Type:iQ scarfold system writen and implemented by CHINATSU IZUMI.
#Inch type scarfold system writen and implemented by MANAMI MIWA.
#These Revit family for temporary scarfold designed by HIROYA MIZUMOTO and MEGUMI TAKASHIMA and MANAMI MIWA and CHINATSU IZUMI.
#And a system provided separately, which counts scaffolding materials designed and writen by MEGUMI TAKASHIMA and MANAMI MIWA,advised the design by HIROYA MIZUMOTO.
#
#■If there is a discrepancy between the content shown in English below and the above Japanese text regarding this software, 
#  the interpretation in the Japanese text shall take precedence.
#
#■ Copyright / Terms of Use / Disclaimer, etc.
#・ Intellectual property rights such as copyrights related to this software belong to the author, S.M.I.Lab (s.m.i.lab.engineers@gmail.com https://github.com/S-M-I-Laboratory).
#・ The user acquires a non-exclusive right to use this software.
#・ The user can copy, modify, and use part or all of this software within the scope of personal use.
#・ Users are not allowed to create exclusive rights based on the knowledge gained by modifying, reverse engineering, or decompiling this software.
#・ This software can be used permanently free of charge as a shared property, and it is intended that it will be continuously modified and developed by volunteers.
#Unless otherwise stated, the terms of this license shall be duplicated. That is, if all or part of this software has been modified, or if any of the technologies 
#provided by this software are used, you may create paid software or change to another license agreement without permission Is not allowed.
#・ This software is provided as it is free of charge and no compensation, and the author does not guarantee normal operation.
#・ Any problems that occur with this software shall be resolved at the user's responsibility.
#・ The author shall not be liable for any damages caused by this software.
#
#Please use this software only if you agree with the above.
#
#■ About the concept of copyright for this system
#As a mechanism for sharing usage rights, instead of waiving copyright, in the form of a license (protected licence for free and no compensation)
#Take measures to protect sharing and collaborative creative activities. That is, "I have right of own the copyright and copy, modify, distribute (sell)"
#All thing is Has need my permission, but to anyone at any time, as long as it does not violate the intention of sharing and developing the software the purpose is to allow the use
#
#As a way to create such a mechanism
#
#"Transitioning a copied / modified shared property from a shared state to an exclusive state" is prohibited without the special permission of the author.
#
#It is based on a methodology, also known as copyleft (for copyright), with a strong willingness to share "does not allow the transition to a monopoly state".
#==================================================================================================

import clr
clr.AddReference('ProtoGeometry')
from Autodesk.DesignScript.Geometry import *
clr.AddReference("RevitNodes")
import Revit
from Revit.Elements import *
clr.AddReference("RevitServices")
import RevitServices
from RevitServices.Persistence import DocumentManager
import System
import math

xplin = []
yplin = []
xendin = []
yendin = []
zzzzzin = []
dataEnteringNode = IN
xplin = IN[0]
yplin = IN[1]
vvvvvin = IN[2]
zpl = IN[6]
zsta = IN[7]
zstp = IN[8]
countz = IN[10]
waku1800 = IN[11]
waku1500 = IN[12]
waku1200 = IN[13]
waku900 = IN[14]
waku600 = IN[15]
waku001 = IN[16]
waku000 = IN[17]
bwaku = IN[18]
ssbk = IN[19]
swaku = IN[20]
esbk = IN[21]
ewaku = IN[22]
zenchouin = IN[23]
xendin = IN[24]
yendin = IN[25]
zzzzzin = IN[26]
tanbu1 = IN[27]
tanbu2 = IN[28]
sheetflg = IN[29]
sheetflg2 = IN[30]
tunagih = IN[31]
tunagil = IN[32]
rakkabou = IN[33]
habaki = IN[34]
tesuri = IN[35]
zsaijoudan = IN[36]
zsaikadan = IN[37]
ichiretu = IN[38]
irekae = IN[39]
ir18 = IN[40]
ir15 = IN[41]
ir12 = IN[42]
ir09 = IN[43]
ir06 = IN[44]
ir01 = IN[45]
ir00 = IN[46]
chouseinashi = IN[47]
jidou = IN[48]
jdesumi = IN[49]
jshiten = IN[50] 
jedesumi = IN[51]
jsyuuten = IN[52]
wakuhaba = IN[53]
j65 = IN[54]
setuzoku1 = IN[55]
setuzoku2 = IN[56]
kyouseitakasa = IN[57]
sheetselect = IN[58]
sheetselect2 = IN[59]
tankanb = IN[60]
asagao = IN[61]
asagaotan = IN[62]
kyouseishitaba = IN[63]
inchiashiba = IN[64]
iqashiba = IN[65]
uchinegaramisoto = IN[66]
sotoatamatsunagisoto = IN[67]
blaketnagasa = IN[68]
kabetunaginagasa = IN[69]
arubatorosu = IN[70]

i = 0
xsta = 0
xstp = 0
ysta = 0
ystp = 0

list0 = []
list1 = []
list2 = []
list3 = []
list4 = []
list5 = []
list6 = []
list7 = [] 
list8 = []
list9 = []
list10 = []
list11 = []
list12 = []
list13 = []
list14 = []
list15 = []
list16 = []
list17 = []
list18 = []
list19 = []
list20 = []
list21 = []
list22 = []
list23 = []
list24 = []
list25 = []
list26 = []
list27 = []
list28 = []
list29 = []
list30 = []
list31 = []
list32 = []
list33 = []
list34 = []
list35 = []
list36 = [] 
list37 = [] 
list38 = []
list39 = []
list40 = []

ffl1 = 0 
ffl2 = 0 
ffl3 = 1 
ffl4 = 0 
ffl5 = 1 
ffl6 = 0 
ffl7 = 0 
ffl8 = 0 
ffl9 = 0 
ffl10 = 0 
ffl11 = 0 
ffl12 = 0 
ffl13 = 0 
ffl14 = 0 
ffl15 = 0 
ffl16 = 'L'
ffl17 = 0
ffl18 = 'セットバック'
ffl19 = 0
ffl20 = 0
ffl21 = 0
ffl22 = 0
ffl23 = 1
ffl24 = 1
ffl25 = 1
ffl26 = 1
ffl27 = 1
ffl28 = 0
ffl29 = 0
ffl34 = 0
ffl35 = 0
ffl36 = 0
ffl37 = 0
ffl38 = blaketnagasa
ffl39 = kabetunaginagasa
ffl40 = 0
l18 = 1800
l15 = 1500
l12 = 1200
l09 = 900
l06 = 600
lc06 = 600
lc03 = 300
lcl = 300
lcc = 65
ltakasa = 1700
sheetname = 0

if inchiashiba == 1:
     l18 = 1829
     l15 = 1524
     l12 = 1219
     l09 = 914
     l06 = 610
     lc06 = 610
     lc03 = 304
     lcl = 305
     lcc = 65
     ltakasa = 1725
iqst = 0
if iqashiba == 1:
     l18 = 1829
     l15 = 1524
     l12 = 1219
     l09 = 914
     l06 = 610
     lc06 = 610
     lc03 = 304
     lcl = 305
     lcc = 0
     ltakasa = 1900 
     iqst = 106
if arubatorosu == 1:
     l18 = 1829
     l15 = 1524
     l12 = 1219
     l09 = 914
     l06 = 610
     lc06 = 610
     lc03 = 304
     lcl = 305
     lcc = 0
     ltakasa = 1800
     iqashiba = 1 
     iqst = 106
     sheetname = 1

familyName = "アルインコ_単管ブラケット足場"
typeName = "1829_H1725"
if tankanb == 1:
     irekae = 1
     familyName = "アルインコ_単管ブラケット足場"
     typeName = "1829_H1725"
     ir18 = FamilyType.ByFamilyNameAndTypeName(familyName, typeName)
     typeName = "1524_H1725"
     ir15 = FamilyType.ByFamilyNameAndTypeName(familyName, typeName)
     typeName = "1219_H1725"
     ir12 = FamilyType.ByFamilyNameAndTypeName(familyName, typeName)
     typeName = "914_H1725"
     ir09 = FamilyType.ByFamilyNameAndTypeName(familyName, typeName)
     typeName = "610_H1725"
     ir06 = FamilyType.ByFamilyNameAndTypeName(familyName, typeName)
     familyName = "アルインコ_単管ブラケット足場 調整スパン"
     typeName = "600_H1725"
     ir01 = FamilyType.ByFamilyNameAndTypeName(familyName, typeName)
     typeName = "300_H1725"
     ir00 = FamilyType.ByFamilyNameAndTypeName(familyName, typeName)

     if zstp == 1725:                                                         
          familyName = "アルインコ_単管ブラケット足場"
          typeName = "1829_H1725"
          ir18 = FamilyType.ByFamilyNameAndTypeName(familyName, typeName)
          typeName = "1524_H1725"
          ir15 = FamilyType.ByFamilyNameAndTypeName(familyName, typeName)
          typeName = "1219_H1725"
          ir12 = FamilyType.ByFamilyNameAndTypeName(familyName, typeName)
          typeName = "914_H1725"
          ir09 = FamilyType.ByFamilyNameAndTypeName(familyName, typeName)
          typeName = "610_H1725"
          ir06 = FamilyType.ByFamilyNameAndTypeName(familyName, typeName)
          familyName = "アルインコ_単管ブラケット足場 調整スパン"
          typeName = "600_H1725"
          ir01 = FamilyType.ByFamilyNameAndTypeName(familyName, typeName)
          typeName = "300_H1725"
          ir00 = FamilyType.ByFamilyNameAndTypeName(familyName, typeName)
     if zstp == 1244:
          familyName = "アルインコ_単管ブラケット足場"
          typeName = "1829_H1244"
          ir18 = FamilyType.ByFamilyNameAndTypeName(familyName, typeName)
          typeName = "1524_H1244"
          ir15 = FamilyType.ByFamilyNameAndTypeName(familyName, typeName)
          typeName = "1219_H1244"
          ir12 = FamilyType.ByFamilyNameAndTypeName(familyName, typeName)
          typeName = "914_H1244"
          ir09 = FamilyType.ByFamilyNameAndTypeName(familyName, typeName)
          typeName = "610_H1244"
          ir06 = FamilyType.ByFamilyNameAndTypeName(familyName, typeName)
          familyName = "アルインコ_単管ブラケット足場 調整スパン"
          typeName = "600_H1244"
          ir01 = FamilyType.ByFamilyNameAndTypeName(familyName, typeName)
          typeName = "300_H1244"
          ir00 = FamilyType.ByFamilyNameAndTypeName(familyName, typeName)
     if zstp == 939:
          familyName = "アルインコ_単管ブラケット足場"
          typeName = "1829_H939"
          ir18 = FamilyType.ByFamilyNameAndTypeName(familyName, typeName)
          typeName = "1524_H939"
          ir15 = FamilyType.ByFamilyNameAndTypeName(familyName, typeName)
          typeName = "1219_H939"
          ir12 = FamilyType.ByFamilyNameAndTypeName(familyName, typeName)
          typeName = "914_H939"
          ir09 = FamilyType.ByFamilyNameAndTypeName(familyName, typeName)
          typeName = "610_H939"
          ir06 = FamilyType.ByFamilyNameAndTypeName(familyName, typeName)
          familyName = "アルインコ_単管ブラケット足場 調整スパン"
          typeName = "600_H939"
          ir01 = FamilyType.ByFamilyNameAndTypeName(familyName, typeName)
          typeName = "300_H939"
          ir00 = FamilyType.ByFamilyNameAndTypeName(familyName, typeName)
     if zstp == 515:
          familyName = "アルインコ_単管ブラケット足場"
          typeName = "1829_H515"
          ir18 = FamilyType.ByFamilyNameAndTypeName(familyName, typeName)
          typeName = "1524_H515"
          ir15 = FamilyType.ByFamilyNameAndTypeName(familyName, typeName)
          typeName = "1219_H515"
          ir12 = FamilyType.ByFamilyNameAndTypeName(familyName, typeName)
          typeName = "914_H515"
          ir09 = FamilyType.ByFamilyNameAndTypeName(familyName, typeName)
          typeName = "610_H515"
          ir06 = FamilyType.ByFamilyNameAndTypeName(familyName, typeName)
          familyName = "アルインコ_単管ブラケット足場 調整スパン"
          typeName = "600_H515"
          ir01 = FamilyType.ByFamilyNameAndTypeName(familyName, typeName)
          typeName = "300_H515"
          ir00 = FamilyType.ByFamilyNameAndTypeName(familyName, typeName)
     if zstp == 1900:
          familyName = "IQ単管ブラケット足場"
          typeName = "IQ18_H1900"
          ir18 = FamilyType.ByFamilyNameAndTypeName(familyName, typeName)
          typeName = "IQ15_H1900"
          ir15 = FamilyType.ByFamilyNameAndTypeName(familyName, typeName)
          typeName = "IQ12_H1900"
          ir12 = FamilyType.ByFamilyNameAndTypeName(familyName, typeName)
          typeName = "IQ09_H1900"
          ir09 = FamilyType.ByFamilyNameAndTypeName(familyName, typeName)
          typeName = "IQ06_H1900"
          ir06 = FamilyType.ByFamilyNameAndTypeName(familyName, typeName)
          familyName = "IQ単管ブラケット足場 調整スパン"
          typeName = "600_H1900"
          ir01 = FamilyType.ByFamilyNameAndTypeName(familyName, typeName)
          typeName = "300_H1900"
          ir00 = FamilyType.ByFamilyNameAndTypeName(familyName, typeName)
     if zstp == 1425:
          familyName = "IQ単管ブラケット足場"
          typeName = "IQ18_H1425"
          ir18 = FamilyType.ByFamilyNameAndTypeName(familyName, typeName)
          typeName = "IQ15_H1425"
          ir15 = FamilyType.ByFamilyNameAndTypeName(familyName, typeName)
          typeName = "IQ12_H1425"
          ir12 = FamilyType.ByFamilyNameAndTypeName(familyName, typeName)
          typeName = "IQ09_H1425"
          ir09 = FamilyType.ByFamilyNameAndTypeName(familyName, typeName)
          typeName = "IQ06_H1425"
          ir06 = FamilyType.ByFamilyNameAndTypeName(familyName, typeName)
          familyName = "IQ単管ブラケット足場 調整スパン"
          typeName = "600_H1425"
          ir01 = FamilyType.ByFamilyNameAndTypeName(familyName, typeName)
          typeName = "300_H1425"
          ir00 = FamilyType.ByFamilyNameAndTypeName(familyName, typeName) 
     if zstp == 2025:                                                      
          familyName = "アルバトロス単管ブラケット足場"
          typeName = "アルバトロス18_H2025"
          ir18 = FamilyType.ByFamilyNameAndTypeName(familyName, typeName)
          typeName = "アルバトロス15_H2025"
          ir15 = FamilyType.ByFamilyNameAndTypeName(familyName, typeName)
          typeName = "アルバトロス12_H2025"
          ir12 = FamilyType.ByFamilyNameAndTypeName(familyName, typeName)
          typeName = "アルバトロス09_H2025"
          ir09 = FamilyType.ByFamilyNameAndTypeName(familyName, typeName)
          typeName = "アルバトロス06_H2025"
          ir06 = FamilyType.ByFamilyNameAndTypeName(familyName, typeName)
          familyName = "アルバトロス単管ブラケット足場 調整スパン"
          typeName = "600_H2025"
          ir01 = FamilyType.ByFamilyNameAndTypeName(familyName, typeName)
          typeName = "300_H2025"
          ir00 = FamilyType.ByFamilyNameAndTypeName(familyName, typeName)
     if zstp == 1800:                                                      
          familyName = "アルバトロス単管ブラケット足場"
          typeName = "アルバトロス18_H1800"
          ir18 = FamilyType.ByFamilyNameAndTypeName(familyName, typeName)
          typeName = "アルバトロス15_H1800"
          ir15 = FamilyType.ByFamilyNameAndTypeName(familyName, typeName)
          typeName = "アルバトロス12_H1800"
          ir12 = FamilyType.ByFamilyNameAndTypeName(familyName, typeName)
          typeName = "アルバトロス09_H1800"
          ir09 = FamilyType.ByFamilyNameAndTypeName(familyName, typeName)
          typeName = "アルバトロス06_H1800"
          ir06 = FamilyType.ByFamilyNameAndTypeName(familyName, typeName)
          familyName = "アルバトロス単管ブラケット足場 調整スパン"
          typeName = "600_H1800"
          ir01 = FamilyType.ByFamilyNameAndTypeName(familyName, typeName)
          typeName = "300_H1800"
          ir00 = FamilyType.ByFamilyNameAndTypeName(familyName, typeName)
     if zstp == 1575:                                                      
          familyName = "アルバトロス単管ブラケット足場"
          typeName = "アルバトロス18_H1575"
          ir18 = FamilyType.ByFamilyNameAndTypeName(familyName, typeName)
          typeName = "アルバトロス15_H1575"
          ir15 = FamilyType.ByFamilyNameAndTypeName(familyName, typeName)
          typeName = "アルバトロス12_H1575"
          ir12 = FamilyType.ByFamilyNameAndTypeName(familyName, typeName)
          typeName = "アルバトロス09_H1575"
          ir09 = FamilyType.ByFamilyNameAndTypeName(familyName, typeName)
          typeName = "アルバトロス06_H1575"
          ir06 = FamilyType.ByFamilyNameAndTypeName(familyName, typeName)
          familyName = "アルバトロス単管ブラケット足場 調整スパン"
          typeName = "600_H1575"
          ir01 = FamilyType.ByFamilyNameAndTypeName(familyName, typeName)
          typeName = "300_H1575"
          ir00 = FamilyType.ByFamilyNameAndTypeName(familyName, typeName)
     if zstp == 1350:                                                      
          familyName = "アルバトロス単管ブラケット足場"
          typeName = "アルバトロス18_H1350"
          ir18 = FamilyType.ByFamilyNameAndTypeName(familyName, typeName)
          typeName = "アルバトロス15_H1350"
          ir15 = FamilyType.ByFamilyNameAndTypeName(familyName, typeName)
          typeName = "アルバトロス12_H1350"
          ir12 = FamilyType.ByFamilyNameAndTypeName(familyName, typeName)
          typeName = "アルバトロス09_H1350"
          ir09 = FamilyType.ByFamilyNameAndTypeName(familyName, typeName)
          typeName = "アルバトロス06_H1350"
          ir06 = FamilyType.ByFamilyNameAndTypeName(familyName, typeName)
          familyName = "アルバトロス単管ブラケット足場 調整スパン"
          typeName = "600_H1350"
          ir01 = FamilyType.ByFamilyNameAndTypeName(familyName, typeName)
          typeName = "300_H1350"
          ir00 = FamilyType.ByFamilyNameAndTypeName(familyName, typeName)
     if zstp == 1125:                                                      
          familyName = "アルバトロス単管ブラケット足場"
          typeName = "アルバトロス18_H1125"
          ir18 = FamilyType.ByFamilyNameAndTypeName(familyName, typeName)
          typeName = "アルバトロス15_H1125"
          ir15 = FamilyType.ByFamilyNameAndTypeName(familyName, typeName)
          typeName = "アルバトロス12_H1125"
          ir12 = FamilyType.ByFamilyNameAndTypeName(familyName, typeName)
          typeName = "アルバトロス09_H1125"
          ir09 = FamilyType.ByFamilyNameAndTypeName(familyName, typeName)
          typeName = "アルバトロス06_H1125"
          ir06 = FamilyType.ByFamilyNameAndTypeName(familyName, typeName)
          familyName = "アルバトロス単管ブラケット足場 調整スパン"
          typeName = "600_H1125"
          ir01 = FamilyType.ByFamilyNameAndTypeName(familyName, typeName)
          typeName = "300_H1125"
          ir00 = FamilyType.ByFamilyNameAndTypeName(familyName, typeName)
     if zstp == 900:                                                      
          familyName = "アルバトロス単管ブラケット足場"
          typeName = "アルバトロス18_H900"
          ir18 = FamilyType.ByFamilyNameAndTypeName(familyName, typeName)
          typeName = "アルバトロス15_H900"
          ir15 = FamilyType.ByFamilyNameAndTypeName(familyName, typeName)
          typeName = "アルバトロス12_H900"
          ir12 = FamilyType.ByFamilyNameAndTypeName(familyName, typeName)
          typeName = "アルバトロス09_H900"
          ir09 = FamilyType.ByFamilyNameAndTypeName(familyName, typeName)
          typeName = "アルバトロス06_H900"
          ir06 = FamilyType.ByFamilyNameAndTypeName(familyName, typeName)
          familyName = "アルバトロス単管ブラケット足場 調整スパン"
          typeName = "600_H900"
          ir01 = FamilyType.ByFamilyNameAndTypeName(familyName, typeName)
          typeName = "300_H900"
          ir00 = FamilyType.ByFamilyNameAndTypeName(familyName, typeName)
     if zstp == 675:                                                      
          familyName = "アルバトロス単管ブラケット足場"
          typeName = "アルバトロス18_H675"
          ir18 = FamilyType.ByFamilyNameAndTypeName(familyName, typeName)
          typeName = "アルバトロス15_H675"
          ir15 = FamilyType.ByFamilyNameAndTypeName(familyName, typeName)
          typeName = "アルバトロス12_H675"
          ir12 = FamilyType.ByFamilyNameAndTypeName(familyName, typeName)
          typeName = "アルバトロス09_H675"
          ir09 = FamilyType.ByFamilyNameAndTypeName(familyName, typeName)
          typeName = "アルバトロス06_H675"
          ir06 = FamilyType.ByFamilyNameAndTypeName(familyName, typeName)
          familyName = "アルバトロス単管ブラケット足場 調整スパン"
          typeName = "600_H675"
          ir01 = FamilyType.ByFamilyNameAndTypeName(familyName, typeName)
          typeName = "300_H675"
          ir00 = FamilyType.ByFamilyNameAndTypeName(familyName, typeName)
     if zstp == 450:                                                      
          familyName = "アルバトロス単管ブラケット足場"
          typeName = "アルバトロス18_H450"
          ir18 = FamilyType.ByFamilyNameAndTypeName(familyName, typeName)
          typeName = "アルバトロス15_H450"
          ir15 = FamilyType.ByFamilyNameAndTypeName(familyName, typeName)
          typeName = "アルバトロス12_H450"
          ir12 = FamilyType.ByFamilyNameAndTypeName(familyName, typeName)
          typeName = "アルバトロス09_H450"
          ir09 = FamilyType.ByFamilyNameAndTypeName(familyName, typeName)
          typeName = "アルバトロス06_H450"
          ir06 = FamilyType.ByFamilyNameAndTypeName(familyName, typeName)
          familyName = "アルバトロス単管ブラケット足場 調整スパン"
          typeName = "600_H450"
          ir01 = FamilyType.ByFamilyNameAndTypeName(familyName, typeName)
          typeName = "300_H450"
          ir00 = FamilyType.ByFamilyNameAndTypeName(familyName, typeName)  

if asagao == 1:
     irekae = 1
     ichiretu = 1
     familyName = "アサガオ(アルインコ)"
     typeName = "朝顔18"
     ir18 = FamilyType.ByFamilyNameAndTypeName(familyName, typeName)
     typeName = "朝顔15"
     ir15 = FamilyType.ByFamilyNameAndTypeName(familyName, typeName)
     typeName = "朝顔12"
     ir12 = FamilyType.ByFamilyNameAndTypeName(familyName, typeName)
     typeName = "朝顔09"
     ir09 = FamilyType.ByFamilyNameAndTypeName(familyName, typeName)
     typeName = "朝顔06"
     ir06 = FamilyType.ByFamilyNameAndTypeName(familyName, typeName)
     familyName = "アサガオ調整スパン(アルインコ)"
     typeName = "朝顔06"
     ir01 = FamilyType.ByFamilyNameAndTypeName(familyName, typeName)
     typeName = "朝顔06"
     ir00 = FamilyType.ByFamilyNameAndTypeName(familyName, typeName)

if asagao == 1 and inchiashiba == 1:                                   
     irekae = 1
     ichiretu = 1
     familyName = "アサガオ(アルインコ)"
     typeName = "朝顔1829"
     ir18 = FamilyType.ByFamilyNameAndTypeName(familyName, typeName)
     typeName = "朝顔1524"
     ir15 = FamilyType.ByFamilyNameAndTypeName(familyName, typeName)
     typeName = "朝顔1219"
     ir12 = FamilyType.ByFamilyNameAndTypeName(familyName, typeName)
     typeName = "朝顔914"
     ir09 = FamilyType.ByFamilyNameAndTypeName(familyName, typeName)
     typeName = "朝顔610"
     ir06 = FamilyType.ByFamilyNameAndTypeName(familyName, typeName)
     familyName = "アサガオ調整スパン(アルインコ)"
     typeName = "朝顔610"
     ir01 = FamilyType.ByFamilyNameAndTypeName(familyName, typeName)
     typeName = "朝顔610"
     ir00 = FamilyType.ByFamilyNameAndTypeName(familyName, typeName)     
     
if asagao == 1 and iqashiba == 1:                                                           
     irekae = 1
     ichiretu = 1
     familyName = "アサガオ(IQ)"
     typeName = "朝顔1829"
     ir18 = FamilyType.ByFamilyNameAndTypeName(familyName, typeName)
     typeName = "朝顔1524"
     ir15 = FamilyType.ByFamilyNameAndTypeName(familyName, typeName)
     typeName = "朝顔1219"
     ir12 = FamilyType.ByFamilyNameAndTypeName(familyName, typeName)
     typeName = "朝顔914"
     ir09 = FamilyType.ByFamilyNameAndTypeName(familyName, typeName)
     typeName = "朝顔610"
     ir06 = FamilyType.ByFamilyNameAndTypeName(familyName, typeName)
     familyName = "アサガオ調整スパン(IQ)"
     typeName = "朝顔610"
     ir01 = FamilyType.ByFamilyNameAndTypeName(familyName, typeName)
     typeName = "朝顔610"
     ir00 = FamilyType.ByFamilyNameAndTypeName(familyName, typeName)     
     
if asagaotan == 1:
     irekae = 1
     ichiretu = 1
     familyName = "アサガオ(単管)"
     typeName = "朝顔18"
     ir18 = FamilyType.ByFamilyNameAndTypeName(familyName, typeName)
     typeName = "朝顔15"
     ir15 = FamilyType.ByFamilyNameAndTypeName(familyName, typeName)
     typeName = "朝顔12"
     ir12 = FamilyType.ByFamilyNameAndTypeName(familyName, typeName)
     typeName = "朝顔09"
     ir09 = FamilyType.ByFamilyNameAndTypeName(familyName, typeName)
     typeName = "朝顔06"
     ir06 = FamilyType.ByFamilyNameAndTypeName(familyName, typeName)
     familyName = "アサガオ調整スパン(単管)"
     typeName = "朝顔06"
     ir01 = FamilyType.ByFamilyNameAndTypeName(familyName, typeName)
     typeName = "朝顔06"
     ir00 = FamilyType.ByFamilyNameAndTypeName(familyName, typeName)

if zsaikadan == 0:
     sheetflg2 = 1

if irekae == 1:
     waku1800 = ir18
     waku1500 = ir15
     waku1200 = ir12
     waku900 = ir09
     waku600 = ir06
     waku001 = ir01
     waku000 = ir00

zsta = zsta + tesuri - zpl + 0.0
countz = math.ceil( zsta / zstp )
ztchousei = 0
if kyouseitakasa <> 0:
     countz = math.floor(kyouseitakasa)
if kyouseishitaba <> 0:
     countz = countz - math.floor(kyouseishitaba)
     ztchousei = math.floor(kyouseishitaba)
     zpl = zpl + zstp * ztchousei
          
if ichiretu ==1:
     zsta = zstp + zpl
     countz = 1
     tesuri = 0

if bwaku == 0:
     bwaku = l18
if swaku <= 0:
     swaku = bwaku

i = 0
ii = 1

xplai = []
yplai = []
zenchouai = []
xendai = []
yendai = []
zzzzzai = []
vvvvvai = []
ai = []

xpl = xplin
ypl = yplin
zenchou = zenchouin
xend = xendin
yend = yendin
zzzzz = zzzzzin
vvvvv = vvvvvin

xpl = float( xpl )
ypl = float( ypl )
zenchou = float( zenchou )
xend = float( xend )
yend = float( yend )
zzzzz = float( zzzzz )

xsta = xend - xpl
xstp = xsta / ( zenchou / bwaku )
ysta = yend - ypl
ystp = ysta / ( zenchou / bwaku )
countxy = ( zenchou / bwaku )

rx = 0
ry = 0
rp = 0
if xsta >= 0:
     rx = 1
else:
     rx = -1
if ysta >= 0:
     ry = 1
else:
     ry = -1
rp = -1 * rx * ry + ( 2 * ( ( rx + ry ) == -2 ) ) + ( -2 * (rx == -1) * (ry == 1) )
vvvvv = vvvvv * rp

xplai.append(xpl)
yplai.append(ypl)
zenchouai.append(zenchou)
xendai.append(xend)
yendai.append(yend)
zzzzzai.append(zzzzz)
vvvvvai.append(vvvvv)
if vvvvvai[i] < 45 and vvvvvai[i] >= -45:
     ai.append(6)
elif vvvvvai[i] < -45 and vvvvvai[i] >= -135:
     ai.append(8)
elif vvvvvai[i] < -135 and vvvvvai[i] >= -225:
     ai.append(4)
elif vvvvvai[i] < 135 and vvvvvai[i] >= 45:
     ai.append(2)
else:
     ai.append(2)

aista = []
aiend = []
aijdesumi = []
aijshiten = [] 
aijedesumi = []
aijsyuuten = []
aisetuzoku1 = []
aisetuzoku2 = []
mae = 0
koko = 0
ato = 0
tojiteiruka = 0
tojiteiruka1 = 0
tojiteiruka2 = 0

defsetuzoku1 = setuzoku1
defsetuzoku2 = setuzoku2
setuzoku1 = defsetuzoku1
setuzoku2 = defsetuzoku2
xpl = xplai[i]
ypl = yplai[i]
zenchou = zenchouai[i]
xend = xendai[i]
yend = yendai[i]
zzzzz = zzzzzai[i]
vvvvv = vvvvvai[i]

xsta = xend - xpl
xstp = xsta / ( zenchou / bwaku )
ysta = yend - ypl
ystp = ysta / ( zenchou / bwaku )
countxy = ( zenchou / bwaku )

zenchou = round(zenchou,1)

countxy = math.floor(countxy)

lchousei = 0
warikiri = 0
j65d = 0
j65ds = 0
tokuteijyouken2 = 0
if jidou == 1:
     if jdesumi == 1:
          if jshiten == 1:
               tanbu1 = 1
               ssbk = - wakuhaba
               swaku = wakuhaba
          if jshiten == 0:
               tanbu1 = 0
               ssbk = lcc
               swaku = bwaku
               lchousei = 1
               j65d = j65d + 1
     if jdesumi == 0:
          if jshiten == 1:
               tanbu1 = 3
               ssbk = 0
               swaku = wakuhaba
          if jshiten == 0:
               tanbu1 = 0
               ssbk = wakuhaba + lcc
               swaku = bwaku
               lchousei = 1
               j65d = j65d + 1
     if jedesumi == 1:
          if jsyuuten == 1:
               tanbu2 = 1
               esbk = - wakuhaba
               ewaku = wakuhaba
          if jsyuuten == 0:
               tanbu2 = 0
               esbk = 0 + (j65 == 1) * lcc
               ewaku = 0 + (j65 == 1) * bwaku
               j65d = j65d + 1
     if jedesumi == 0:
          if jsyuuten == 1:
               tanbu2 = 3
               esbk = 0
               ewaku = wakuhaba
          if jsyuuten == 0:
               tanbu2 = 0
               esbk = wakuhaba + (j65 == 1) * lcc
               ewaku = 0 + (j65 == 1) * bwaku
               j65d = j65d + 1
     if setuzoku1 == 1:
          tanbu1 = 0
          if jshiten == 1:
               ssbk = 0
               swaku = bwaku
          if jshiten == 0:
               ssbk = wakuhaba
               swaku = bwaku
     if setuzoku2 == 1:
          tanbu2 = 0


kyouseisc = 0
kyouseiec = 0
kyouseisn = 0
kyouseien = 0
if tanbu1 == 4 and lcc > 0:
     jidou = 0
     tanbu1 = 0
     kyouseisc = 1
if tanbu1 == 5:
     jidou = 0
     tanbu1 = 0
     kyouseisn = 1
if tanbu2 == 4 and lcc > 0:
     jidou = 0
     tanbu2 = 0
     kyouseiec = 1
if tanbu2 == 5:
     jidou = 0
     tanbu2 = 0
     kyouseien = 1
if ewaku > 0:
     ewakufl = 0
elif ewaku == 0:
     ewakufl = 1
else:
     ewaku = 0
     ewakufl = 2

strc = 0
strcxy = 0
strcz = 0
each = strc
peach = strcz
b1waku = waku1800
waku = b1waku
if bwaku <= 0:
     b1waku = waku000
     waku = b1waku
elif bwaku < lc03:
     b1waku = waku000
     waku = b1waku
elif bwaku < l06:
     b1waku = waku001
     waku = b1waku
elif bwaku < l09:
     b1waku = waku600
     waku = b1waku
elif bwaku < l12:
     b1waku = waku900
     waku = b1waku
elif bwaku < l15:
     b1waku = waku1200
     waku = b1waku
elif bwaku < l18:
     b1waku = waku1500
     waku = b1waku
else:
     pass
supan = zenchou - ssbk - swaku - esbk - ewaku

tokuteij3 = 0

if supan < lcc or swaku <l06:
     if jidou == 1:

          if jshiten == 1 and jsyuuten == 0:
               
               ssbk = -wakuhaba * (jdesumi == 1) + lcc * (jdesumi == 0)
               swaku = wakuhaba
               
               ewaku = 0
               esbk = (wakuhaba) * (jedesumi == 0) + lcc * (jedesumi == 1)
               supan = zenchou - ssbk - swaku - esbk - ewaku
               tokuteijyouken2 = 0


          if jshiten == 0 and jsyuuten == 0:
               ssbk = (wakuhaba + lcc) * (jdesumi == 0) + lcc * (jdesumi == 1)
               swaku = 0
               esbk = (wakuhaba) * (jedesumi == 0) + 0 * (jedesumi == 1)
               ewaku = 0
               supan = zenchou - ssbk - swaku - esbk - ewaku
               tokuteijyouken2 = 0
               if supan >= l06 + lcc:
                    if l18 <= bwaku and l18 <= supan:
                         swaku = l18
                    elif l15 <= bwaku and l15 <= supan:
                         swaku = l15                         
                    elif l12 <= bwaku and l12 <= supan:
                         swaku = l12
                    elif l09 <= bwaku and l09 <= supan:
                         swaku = l09
                    elif l06 <= bwaku and l06 <= supan:
                         swaku = l06
                    else:
                         swaku = supan
                    supan = zenchou - ssbk - swaku - esbk - ewaku
                    if supan + esbk < l06 + lcc:
                         esbk = (wakuhaba) * (jedesumi == 0) + 0 * (jedesumi == 1)
                         swaku = 0
                         supan = zenchou - ssbk - swaku - esbk - ewaku
                         if l18 <= bwaku and l18 <= supan:
                              swaku = l18
                         elif l15 <= bwaku and l15 <= supan:
                              swaku = l15                         
                         elif l12 <= bwaku and l12 <= supan:
                              swaku = l12
                         elif l09 <= bwaku and l09 <= supan:
                              swaku = l09
                         elif l06 <= bwaku and l06 <= supan:
                              swaku = l06
                         else:
                              swaku = supan
                         supan = zenchou - ssbk - swaku - esbk - ewaku
               else:
                    ssbk = (wakuhaba) * (jdesumi == 0) + 0 * (jdesumi == 1)
                    
                    esbk = wakuhaba * (jedesumi == 0)  + 0 * (jedesumi == 1)
                    ewaku = 0
                    swaku = zenchou - ssbk - esbk - ewaku
                    tokuteij3 = swaku
                    supan = zenchou - ssbk - swaku - esbk - ewaku
               if supan < lcc and swaku >= l06:
                    ssbk = (wakuhaba + lcc) * (jdesumi == 0) + lcc * (jdesumi == 1)
                    esbk = wakuhaba * (jedesumi == 0) + 0 * (jedesumi == 1)
                    if l18 <= swaku:
                         swaku = l15
                    elif l15 <= swaku:
                         swaku = l12                         
                    elif l12 <= swaku:
                         swaku = l09
                    elif l09 <= swaku:
                         swaku = l06
                    elif l06 <= swaku:
                         swaku = l06
                    else:
                         swaku = l06
                    ewaku = 0
                    supan = zenchou - ssbk - swaku - esbk - ewaku
                    tokuteij3 = 0
               if swaku < l06 or supan < 0:
                    ssbk = (wakuhaba) * (jdesumi == 0) + 0 * (jdesumi == 1)
                    esbk = wakuhaba * (jedesumi == 0) + 0 * (jedesumi == 1)
                    ewaku = 0
                    swaku = zenchou - ssbk - esbk - ewaku
                    tokuteij3 = swaku
                    supan = zenchou - ssbk - swaku - esbk - ewaku

          supan = zenchou - ssbk - swaku - esbk - ewaku
         
rzenchou = zenchou - ssbk - esbk
szenchou = zenchou - ssbk - swaku
ezenchou = zenchou - ssbk - swaku - esbk

zzzzzf = 0 
bwakus = 0
shoutotu = 0
loopfx = 0
if supan >= 0:
     chousei = supan / bwaku
     bwakus = math.floor(chousei)
     chousei = supan - ( bwaku * bwakus )
     
     if chousei <> 0 and chousei < (lcc + iqst) :
          if bwakus == 1:
               chousei = chousei + bwaku
               bwakus = 0
               shoutotu = 1
               loopfx = -1
          else:
               bwakus = bwakus - (bwakus > 0)
               chousei = chousei + bwaku * (bwakus > 0)
               shoutotu = 1

     else:
          supan = zenchou - ssbk - swaku - esbk - ewaku
          warikiri = ((math.floor( supan / lcl )) == ( supan / lcl ))
          j65ds = lcl - (lcl*(( supan / lcl ) - (math.floor( supan / lcl ))))
          if j65ds < (lcc + iqst) or j65ds > (lcl - (lcc + iqst)):
               if j65ds <> 0 and j65ds < lcl:
                    shoutotu = 1

     shoutotu = 0
     chousei = supan%bwaku
     bwakus = math.floor(supan / bwaku)
     
     if szenchou < 0:
          chousei = 0.0
          zzzzzf = 4
     elif ezenchou < 0:
          chousei = 0.0
          zzzzzf = 3
     elif supan < bwaku:
          zzzzzf = 2
     elif supan < ( bwaku + lc03 ):
          zzzzzf = 1
     else:
          zzzzzf = 0
else:
     chousei = 0.0
     zzzzzf = 4

if chouseinashi == 0:
     chousei = 0

loopcnt = 0
if zzzzzf == 1:
     loopcnt = 3 + ( chousei > 0 ) 
elif zzzzzf == 2:
     loopcnt = 2 + ( chousei > 0 ) 
elif zzzzzf == 3:
     loopcnt = 1 + ( chousei > 0 )
elif zzzzzf == 4:
     loopcnt = 0
else:
     loopcnt = 2 + bwakus + ( chousei > 0 )

cfl = 0
chousei0 = 0
chouseix = 0
rchousei = 0
warikiri = ((supan%bwaku) == 0)

c00 = 0

iqwarikiri = 0
zzchousei = (supan%bwaku)

if iqst > 0:
     if zzchousei-l18 == 0:
          iqwarikiri = 1
     if zzchousei-l15 == 0:
          iqwarikiri = 1
     if zzchousei-l12 == 0:
          iqwarikiri = 1
     if zzchousei-l09 == 0:
          iqwarikiri = 1
     if zzchousei-l06 == 0:
          iqwarikiri = 1
     if zzchousei-l12-l09 == 0:
          iqwarikiri = 1
     if zzchousei-lc03 == 0:
          iqwarikiri = 1
     if zzchousei == 0:
          iqwarikiri = 1
 
if iqwarikiri == 0 and iqst > 0:
     if zzchousei-l18 < iqst and zzchousei-l18 > 0:
          shoutotu = 1
     if zzchousei-l15 < iqst and zzchousei-l15 > 0:
          shoutotu = 1
     if zzchousei-l12 < iqst and zzchousei-l12 > 0:
          shoutotu = 1
     if zzchousei-l09 < iqst and zzchousei-l09 > 0:
          shoutotu = 1
     if zzchousei-l06 < iqst and zzchousei-l06 > 0:
          shoutotu = 1
     if zzchousei-l12-l09 < iqst and zzchousei-l12-l09 > 0:
          shoutotu = 1
     if zzchousei-lc03 < iqst and zzchousei-lc03 > 0:
          shoutotu = 1
     if zzchousei < iqst and zzchousei > 0:
          shoutotu = 1
          chousei = chousei + bwaku*(bwakus>0)
          bwakus = bwakus - 1*(bwakus>0)
          loopcnt = loopcnt - 1*(bwakus>1)

if tanbu2 > 0 and tanbu2 < 4:
     if zzchousei-l18 == 0 and lcc > 0:
          iqwarikiri = 1
     if zzchousei-l15 == 0 and lcc > 0:
          iqwarikiri = 1
     if zzchousei-l12 == 0 and lcc > 0:
          iqwarikiri = 1
     if zzchousei-l09 == 0 and lcc > 0:
          iqwarikiri = 1
     if zzchousei-l06 == 0 and lcc > 0:
          iqwarikiri = 1
     if zzchousei-l12-l09 == 0 and lcc > 0:
          iqwarikiri = 1
     if zzchousei-lc03 == 0 and lcc > 0:
          iqwarikiri = 1
     if zzchousei == 0 and lcc > 0:
          iqwarikiri = 1

if tanbu2 < 1 or tanbu2 > 3:
     if zzchousei-l18-lcc == 0 and lcc > 0:
          iqwarikiri = 1
     if zzchousei-l15-lcc == 0 and lcc > 0:
          iqwarikiri = 1
     if zzchousei-l12-lcc == 0 and lcc > 0:
          iqwarikiri = 1
     if zzchousei-l09-lcc == 0 and lcc > 0:
          iqwarikiri = 1
     if zzchousei-l06-lcc == 0 and lcc > 0:
          iqwarikiri = 1
     if zzchousei-l12-l09-lcc == 0 and lcc > 0:
          iqwarikiri = 1
     if zzchousei-lc03-lcc == 0 and lcc > 0:
          iqwarikiri = 1
     if zzchousei-lcc == 0 and lcc > 0:
          iqwarikiri = 1

if iqwarikiri == 0 and lcc > 0:
     if tanbu2 < 1 or tanbu2 > 3:
          if zzchousei-l18 < lcc and zzchousei-l18 >= 0:
               shoutotu = 1
          if zzchousei-l15 < lcc and zzchousei-l15 >= 0:
               shoutotu = 1
          if zzchousei-l12 < lcc and zzchousei-l12 >= 0:
               shoutotu = 1
          if zzchousei-l09 < lcc and zzchousei-l09 >= 0:
               shoutotu = 1
          if zzchousei-l06 < lcc and zzchousei-l06 >= 0:
               shoutotu = 1
          if zzchousei-l12-l09 < lcc and zzchousei-l12-l09 >= 0:
               shoutotu = 1
          if zzchousei-lc03 < lcc and zzchousei-lc03 >= 0:
               shoutotu = 1
          if zzchousei < lcc and zzchousei >= 0:
               shoutotu = 1
               chousei = chousei + bwaku*(bwakus>0)
               bwakus = bwakus - 1*(bwakus>0)
               loopcnt = loopcnt - 1*(bwakus>1)
     if tanbu2 > 0 and tanbu2 < 4:
          if zzchousei-l18 < lcc and zzchousei-l18 > 0:
               shoutotu = 1
          if zzchousei-l15 < lcc and zzchousei-l15 > 0:
               shoutotu = 1
          if zzchousei-l12 < lcc and zzchousei-l12 > 0:
               shoutotu = 1
          if zzchousei-l09 < lcc and zzchousei-l09 > 0:
               shoutotu = 1
          if zzchousei-l06 < lcc and zzchousei-l06 > 0:
               shoutotu = 1
          if zzchousei-l12-l09 < lcc and zzchousei-l12-l09 > 0:
               shoutotu = 1
          if zzchousei-lc03 < lcc and zzchousei-lc03 > 0:
               shoutotu = 1
          if zzchousei < lcc and zzchousei > 0:
               shoutotu = 1
               chousei = chousei + bwaku*(bwakus>0)
               bwakus = bwakus - 1*(bwakus>0)
               loopcnt = loopcnt - 1*(bwakus>1)

jjjzzz = ((iqst + lcc) *(iqwarikiri==0) )

iqtokusyu = 0
if chousei < iqst and chousei > 0 and iqst > 0 and swaku > lcl and iqwarikiri == 0:
     if (swaku + chousei) < (l06 + lcc + iqst) and (swaku + chousei) > l06:
          chousei = swaku + chousei
          swaku = 0
          supan = 0
          cfl = 1
          iqtokusyu = 1
          
          c0waku = waku000
          c1waku = waku000
          chousei1 = 0
          chousei2 = 0
          chouseix = chousei
          chousei = 0
          rchousei = 1
          c00 = 1

     else:
          swaku = swaku - lcl
          chousei = chousei + lcl

if iqtokusyu == 1:
     pass

elif chousei == 0 and supan%bwaku == 0 and supan >= bwaku and iqwarikiri == 1 and jsyuuten == 0 and lcc > 0: 
     chousei = bwaku 
     bwakus = bwakus - 1

     if bwaku == l18:
          if bwakus > 0:
               c0waku = waku1800
               c1waku = waku1500
               chousei0 = l18
               chousei1 = l15
               chousei2 = chousei - chousei1
               chouseix = chousei - chousei1
               cfl = 1
          else:
               c1waku = waku1500
               chousei1 = l15
               chousei2 = chousei - chousei1
                           
     elif bwaku == l15:
          if bwakus > 0:
               c0waku = waku1500
               c1waku = waku1200
               chousei0 = l15
               chousei1 = l12
               chousei2 = chousei - chousei1
               chouseix = chousei - chousei1
               cfl = 1
          else:
               c1waku = waku1200
               chousei1 = l12
               chousei2 = chousei - chousei1
     elif bwaku == l12:
          if bwakus > 0:
               c0waku = waku1200
               c1waku = waku900
               chousei0 = l12
               chousei1 = l09
               chousei2 = chousei - chousei1
               chouseix = chousei - chousei1
               cfl = 1
          else:
               c1waku = waku900
               chousei1 = l09
               chousei2 = chousei - chousei1
     elif bwaku == l09:
          if bwakus > 0:
               c0waku = waku900
               c1waku = waku600
               chousei0 = l09
               chousei1 = l06
               chousei2 = chousei - chousei1
               chouseix = chousei - chousei1
               cfl = 1
          else:
               c1waku = waku600
               chousei1 = l06
               chousei2 = chousei - chousei1
     elif bwaku == l06:
          if bwakus > 0:
               c0waku = waku600
               c1waku = waku001
               chousei0 = l06
               chousei1 = lc06
               chousei2 = chousei - chousei1
               chouseix = chousei - chousei1
               cfl = 1
          else:
               c1waku = waku001
               chousei1 = lc06
               chousei2 = chousei - chousei1
     else:
          if bwakus > 0:
               c0waku = waku1800
               c1waku = waku1500
               chousei0 = l18
               chousei1 = l15
               chousei2 = chousei - chousei1
               chouseix = chousei - chousei1
               cfl = 1
          else:
               c1waku = waku1500
               chousei1 = l15
               chousei2 = chousei - chousei1

elif chousei <= 0:
     c1waku = waku000
     chousei1 = 0
     chousei2 = 0
     chouseix = chousei
     rchousei = 1
elif chousei <= 0 + jjjzzz:
     c1waku = waku000
     chousei1 = 0
     chousei2 = 0
     chouseix = chousei
     rchousei = 1
     c00 = 1
elif chousei < lc03 + jjjzzz:
     c1waku = waku000
     chousei1 = chousei
     chousei2 = 0
     chouseix = chousei
elif chousei == lc03 + jjjzzz and zzzzzf == 0:
     if bwaku >= l18:
          c0waku = waku1200
          c1waku = waku900
          chousei0 = l12
          chousei1 = l09
          chousei2 = chousei - lcl
          chouseix = chousei - lcl
          cfl = 1 
     elif bwaku >= l15:
          c0waku = waku900
          c1waku = waku900
          chousei0 = l09
          chousei1 = l09
          chousei2 = chousei - lcl
          chouseix = chousei - lcl
          cfl = 1 
     elif bwaku >= l12:
          c0waku = waku900
          c1waku = waku600
          chousei0 = l09
          chousei1 = l06
          chousei2 = chousei - lcl
          chouseix = chousei - lcl
          cfl = 1 
     elif bwaku >= l09:
          c0waku = waku600
          c1waku = waku600
          chousei0 = l06
          chousei1 = l06
          chousei2 = chousei - lcl
          chouseix = chousei - lcl
          cfl = 1 
     else:
          c0waku = waku600
          c1waku = waku600
          chousei0 = l06
          chousei1 = l06
          chousei2 = chousei - lcl
          chouseix = chousei - lcl
          cfl = 1 

elif chousei < lc06 + jjjzzz and zzzzzf > 0: 
     c1waku = waku001
     chousei1 = chousei
     chousei2 = 0
     chouseix = chousei
elif chousei < l06 + jjjzzz and bwaku <= l06:
     c1waku = waku001
     chousei1 = chousei
     chousei2 = 0
     chouseix = chousei
     
elif chousei < l06 + jjjzzz:

     if bwaku >= l18:
          c0waku = waku1200
          c1waku = waku900
          chousei0 = l12
          chousei1 = l09
          chousei2 = chousei - lcl
          chouseix = chousei - lcl
          cfl = 1 
     elif bwaku >= l15:
          c0waku = waku900
          c1waku = waku900
          chousei0 = l09
          chousei1 = l09
          chousei2 = chousei - lcl
          chouseix = chousei - lcl
          cfl = 1 
     elif bwaku >= l12:
          c0waku = waku900
          c1waku = waku600
          chousei0 = l09
          chousei1 = l06
          chousei2 = chousei - lcl
          chouseix = chousei - lcl
          cfl = 1 
     elif bwaku >= l09:
          c0waku = waku600
          c1waku = waku600
          chousei0 = l06
          chousei1 = l06
          chousei2 = chousei - lcl
          chouseix = chousei - lcl
          cfl = 1 
     else:
          c0waku = waku600
          c1waku = waku600
          chousei0 = l06
          chousei1 = l06
          chousei2 = chousei - lcl
          chouseix = chousei - lcl
          cfl = 1 
elif chousei < l09 + jjjzzz:
     c1waku = waku600
     chousei1 = l06
     chousei2 = chousei - chousei1
elif chousei < l12 + jjjzzz:
     c1waku = waku900
     chousei1 = l09
     chousei2 = chousei - chousei1
elif chousei < l15 + jjjzzz:
     c1waku = waku1200
     chousei1 = l12
     chousei2 = chousei - chousei1
elif chousei < l18 + jjjzzz:
     c1waku = waku1500
     chousei1 = l15
     chousei2 = chousei - chousei1
else:
     c1waku = waku1800
     chousei1 = l18
     chousei2 = chousei - chousei1

chousei3 = 0
chouseixx = 0
if chousei2 == 65:
     c2waku = waku000
     chouseixx = chousei2
     chousei2 = 0
     chousei3 = 0
     rchousei = 1
     c00 = 2
elif chousei2 <= 0:
     c2waku = waku000
     chouseixx = chousei2
     chousei2 = 0
     chousei3 = 0
     rchousei = 1
elif chousei2 <= 0 + jjjzzz:
     c2waku = waku000
     chouseixx = chousei2
     chousei2 = 0
     chousei3 = 0
     rchousei = 1
     c00 = 2
elif chousei2 < lc03 + jjjzzz:
     c2waku = waku000
     chouseixx = chousei2
     chousei3 = chousei2
elif chousei2 < lc06 + jjjzzz:
     c2waku = waku001
     chouseixx = chousei2
     chousei3 = chousei2
elif chousei2 < l09 + jjjzzz:
     c2waku = waku600
     chousei2 = l06
     chousei3 = chousei - chousei1 - chousei2
elif chousei2 < l12 + jjjzzz:
     c2waku = waku900
     chousei2 = l09
     chousei3 = chousei - chousei1 - chousei2
elif chousei2 < l15 + jjjzzz:
     c2waku = waku1200
     chousei2 = l12
     chousei3 = chousei - chousei1 - chousei2
elif chousei2 < l18 + jjjzzz:
     c2waku = waku1500
     chousei2 = l15
     chousei3 = chousei - chousei1 - chousei2
else:
     c2waku = waku1800
     chousei2 = l18
     chousei3 = chousei - chousei1 - chousei2

loopcnt = loopcnt + ( chousei0 > 0 ) + ( chousei3 > 0 ) + loopfx

cx = 0
cy = 0
ccount = supan / bwaku
ccount = math.floor(ccount)
clen = ssbk + swaku + ( ccount * bwaku ) 
if zenchou <> 0 and clen <> 0:
     cx = xsta / ( zenchou / clen ) 
     cy = ysta / ( zenchou / clen )  
c1wakux = 0
c1wakuy = 0
if chousei1 <> 0 and zenchou <> 0:
     c1wakux = xsta / ( zenchou / chousei1 ) 
     c1wakuy = ysta / ( zenchou / chousei1 ) 

if zenchou <> 0 and ( clen + chousei1 ) <> 0:
     cx2 = xsta / ( zenchou / ( clen + chousei1 ) ) 
     cy2 = ysta / ( zenchou / ( clen + chousei1 ) ) 
c2wakux = 0
c2wakuy = 0
if chousei2 <> 0 and zenchou <> 0:
     c2wakux = xsta / ( zenchou / chousei2 ) 
     c2wakuy = ysta / ( zenchou / chousei2 ) 

cx0 = 0
cy0 = 0
if chousei0 <> 0 and zenchou <> 0 and ( clen - bwaku + chousei0 ) <> 0:
     cx0 = xsta / ( zenchou / ( clen - bwaku + chousei0 ) ) 
     cy0 = ysta / ( zenchou / ( clen - bwaku + chousei0 ) ) 
c0wakux = 0
c0wakuy = 0
if chousei0 <> 0 and zenchou <> 0:
     c0wakux = xsta / ( zenchou / chousei0 ) 
     c0wakuy = ysta / ( zenchou / chousei0 ) 

bwakux = 0
bwakuy = 0
if chousei2 <> 0 and zenchou <> 0 and bwaku <> 0:
     bwakux = xsta / ( zenchou / bwaku ) 
     bwakuy = ysta / ( zenchou / bwaku ) 

ex = 0
ey = 0 
if zenchou <> 0 and ( (zenchou) - ( ssbk + swaku + esbk + ewaku ) ) <> 0:
     ex = xsta / ( (zenchou)  / ( (zenchou) - ( ssbk + swaku + esbk + ewaku ) ) )
     ey = ysta / ( (zenchou) / ( (zenchou) - ( ssbk + swaku + esbk + ewaku ) ) ) 
if zenchou <> 0 and ( (zenchou) - ( ssbk + swaku + esbk + ewaku ) ) == 0:
     ex = 0
     ey = 0
ewakux = 0
ewakuy = 0
if ewaku <> 0:
     ewakux = xsta / ( (zenchou) / ewaku ) 
     ewakuy = ysta / ( (zenchou) / ewaku ) 

e1waku = waku1800
cfl2 = 0
chouseixxx = 0
supanchouseifl = 0
if ewaku <= 0:
     e1waku = waku000
     cfl2 = 1
     chouseixxx = ewaku
     rchousei = 1
elif ewaku < lc03:
     e1waku = waku000
     chouseixxx = ewaku
     supanchouseifl = 1
elif ewaku < lc06:
     e1waku = waku001
     chouseixxx = ewaku
     supanchouseifl = 1
elif ewaku < l09:
     e1waku = waku600
elif ewaku < l12:
     e1waku = waku900
elif ewaku < l15:
     e1waku = waku1200
elif ewaku < l18:
     e1waku = waku1500
else:
     pass

if zstp < ltakasa:
     cfl2 = 1

sx = 0
sy = 0
if zenchou <> 0 and ssbk <> 0: 
     sx = xsta / ( zenchou / ssbk )
     sy = ysta / ( zenchou / ssbk )
swakux = 0
swakuy = 0
if swaku <> 0:
     swakux = xsta / ( zenchou / swaku )
     swakuy = ysta / ( zenchou / swaku )

s1waku = waku1800
if swaku <= 0:
     pass
elif swaku < lc03:
     s1waku = waku000
elif swaku < l06:
     s1waku = waku001
elif swaku < l09 and tokuteij3 > 0:
     s1waku = waku001
elif swaku < l09:
     s1waku = waku600
     swaku = l06
elif swaku < l12:
     s1waku = waku900
     swaku = l09
elif swaku < l15:
     s1waku = waku1200
     swaku = l12
elif swaku < l18:
     swaku = l15
     s1waku = waku1500
elif swaku == l18:
     swaku = l18
     s1waku = waku1800
else:
     pass

countxy = ( ( zenchou - ssbk - swaku - esbk - ewaku ) / bwaku ) + 1
countxyi = math.floor(countxy)
xzz = 0
yzz = 0
cfl3 = 0

loopcnt = loopcnt - (cfl)
while peach < (countz - 0):

     enfl = 0
     ffl27 = 1
     ffl8z = 0
     fflsd12 = 0
     each = 0
     while each < ( loopcnt ):

          saisyonogyou = 0
          x = xpl + sx - (xstp - swakux) + ( xstp * (each - strcxy) )
          y = ypl + sy - (ystp - swakuy) + ( ystp * (each - strcxy) )
          z = zpl + ( zstp * (peach - strcz) )
          if each == 0:
               waku = s1waku
               saisyonogyou = 1
               x = xpl + sx
               y = ypl + sy

          if cfl == 1 and ( each ) == ( bwakus - 0 + 0 ):
               waku = c0waku

          if ( each ) == ( bwakus - 0 + 1 ):
               waku = c1waku
               if cfl == 1:
                    x = xpl + sx - (xstp - swakux) + ( xstp * (each - 1 ) - strcxy) + c0wakux
                    y = ypl + sy - (ystp - swakuy) + ( ystp * (each - 1 ) - strcxy) + c0wakuy
                    xzz = x
                    yzz = y

          if ( each ) == ( bwakus - 0 + 2 ):
               waku = c2waku
               x = xpl + sx + swakux + ex
               y = ypl + sy + swakuy + ey
               if cfl == 1:
                    x = xzz + c1wakux +c2wakux 
                    y = yzz + c1wakuy +c2wakuy 

          if ( each ) == ( loopcnt - 1 ) and each <> 0:
               waku = e1waku
               x = xpl + sx + swakux + ex 
               y = ypl + sy + swakuy + ey 
               enfl = 1

          z= z + zzzzz
          if ( each ) == ( loopcnt - 1 ) and each <> 0 and ewakufl <> 0:
               pass
          elif ( each ) == ( loopcnt - 2 ) and chousei2 <> 0 and each <> 0 and ewakufl == 2:
               pass
          elif cfl == 1 and ( each ) == ( bwakus - 0 + 2 ) and chousei3 <> 0 and ewakufl == 2:
               pass

          else:
               ffl1 = 0
               ffls1 = 0
               fflss1 = 0
               if ( peach + 1 ) >= (countz - 0):
                    ffl1 = 1
                    ffls1 = 1
               if ( peach + 2 ) >= (countz - 0) and ffls1 == 0:
                    fflss1 = 1
               ffl2 = 0
               ffls2 = 0
               if peach == 0:
                    ffl2 = 1
                    ffls2 = 1
               ffl3 = 0
               ffls3 = 0
               ffl8 = 0

               if each == 0:
                    ffl8 = 1
                    if tanbu1 > 0:
                         ffls3 = 1
                         ffl3 = 1

               ffl4 = 0
               ffls4 = 0
               if ( each + 1 ) >= ( loopcnt - 0 ) and tanbu2 > 0:
                    ffl4 = 1
                    ffls4 = 1
               ffl5 = 0
               if sheetflg == 1:
                    ffl5 = 1
               ffl6 = 0
               ffls6 = 0
               ffl15 = 0
               if sheetflg == 1 and ffls4 == 1 and tanbu2 > 0:
                    ffl6 = 1
                    ffls6 = 1
                    ffl15 = 1
               ffl7 = 0
               ffls7 = 0
               ffl14 = 0
               
               if sheetflg == 1 and ffls3 == 1 and tanbu1 > 0:
                    ffl7 = 1
                    ffls7 = 1
                    ffl14 = 1
               if sheetflg2 == 0 and ffls2 == 1:
                    ffl5 = 0
                    ffl6 = 0
                    ffl7 = 0

               ffl28 = 0
               if ffl8 == 1 and lchousei == 1:
                    ffl28 = 1
                    
               if ffl8 == 1 and lchousei == 1 and arubatorosu == 1:
                    ffl28 = 0

               ffl29 = 0
               if jidou == 1 and chouseix == 0 and chouseixx == 0 and cfl == 0 and ( each ) == ( bwakus - 0 + 0 ) and chousei2 == 0 and rchousei == 1 and jsyuuten == 0:
                    ffl29 = 1
                    if arubatorosu == 1:
                         ffl29 = 0
               if jidou == 1 and chouseix == 0 and chouseixx == 0 and cfl == 1 and ( each ) == ( bwakus - 0 + 1 ) and chousei3 == 0 and rchousei == 1 and jsyuuten == 0:
                    ffl29 = 1
                    if arubatorosu == 1:
                         ffl29 = 0
               zzz1 = ( each ) == ( bwakus - 0 + 0 )
               zzz2 = ( each ) == ( bwakus - 0 + 0 )
               zzz3 = rchousei

               ffl9 = 0
               ffls9 = 0
               fflss9 = 0.0
               fflsss9 = peach + 1.0
               fflssss9 = peach + 0.0
               if zsaikadan == 0:
                    fflsss9 = peach  + 2.0
                    fflssss9 = peach + 1.0
               ffl10 = 0
               ffl11 = 0
               if rakkabou > 0:
                    fflss9 = (fflsss9 + ztchousei) / rakkabou
                    fflsss9 = int(fflss9)
                    fflssss9 = (fflssss9 + ztchousei) / rakkabou
                    fflssss9 = int(fflssss9)

               if ( fflssss9 + 1 ) == fflsss9 and rakkabou > 0 and fflss9 > 0 and fflsss9 > 0:
                    ffls9 = 1
               if ffls2 == 1 and zsaikadan == 1 and ztchousei == 0:
                    ffls9 = 0
               if ffls1 == 1:
                    ffls9 = 0
               if fflss1 == 1:
                    ffls9 = 1                    
               if rakkabou > 0 and ffls9 == 1:
                    ffl9 = 1
                    ffl11 = 1
               if ffls7 == 1 and rakkabou > 0 and ffls9 == 1:                    
                    ffl10 = 1

               ffl12 = 0
               ffls12 = 0
               fflss12 = 0.0
               fflsss12 = peach + 0.0
               fflssss12 = peach - 1.0
               if zsaikadan == 0:
                    fflsss12 = peach  + 1.0
                    fflssss12 = peach + 0.0
               if tunagih > 0:
                    fflss12 = (fflsss12 + ztchousei) / tunagih
                    fflsss12 = int(fflss12)
                    fflssss12 = (fflssss12 + ztchousei) / tunagih
                    fflssss12 = int(fflssss12)

               if ( fflssss12 + 1 ) == fflsss12 and tunagih > 0 and fflss12 > 0 and fflsss12 > 0:
                    ffls12 = 1
                    fflsd12 = 1
               if ffls2 == 1 and zsaikadan == 1:
                    ffls12 = 1
                    fflsd12 = 1
               if ffls1 == 1 and fflsd12 == 0:
                    ffls12 = 1
                    fflsd12 = 1
               if fflss1 == 1:
                    pass
                    
               fflx12 = each + 1.0
               if tunagil > 0:
                    fflx12 = fflx12 / tunagil
               fflx12 = int(fflx12)
               fflxx12 = each + 0.0
               if tunagil > 0:
                    fflxx12 = fflxx12 / tunagil
               fflxx12 = int(fflxx12)
               fflxxx12 = 0
               fflxxxx12 = 0               
               if tunagih > 0 and ffls12 == 1 and tunagil > 0:
                    if ( fflxx12 + 1 ) == fflx12:
                         ffl12 = 1
                    if ( each ) == 0:
                         ffl12 = 0
                    if ( each + 1 ) >= (loopcnt - 0):
                         fflxxx12 = 1
                         ffl12 = 0
                    if ( each + 2 ) >= (loopcnt - 0) and fflxxx12 == 0:
                         fflxxxx12 = 1  
                         ffl12 = 1                   

               ffl13 = 1
               ffl21 = 0
               ffl22 = 0
               if ffls4 == 1 and tanbu2 == 1:         
                    if ffls2 == 0:
                         ffl13 = 0
                    ffl10 = 0
                    ffl11 = 0 
                    ffl13 = 0
                    if ffl9 == 1:
                         ffl22 = 0
                         if enfl == 1:
                              ffl9 = 0

               if ffls3 == 1 and tanbu1 == 1:         
                    if ffls2 == 0:
                         ffl13 = 0
                    ffl10 = 0
                    ffl11 = 0 
                    ffl13 = 0
                    if ffl10 == 1:
                         ffl21 = 0

               ffl20 = 1
               ffl27 = 1
               if ffls4 == 1 and tanbu2 == 3:           
                    if ffls2 == 0:
                         ffl20 = 0
                    ffl5 = 0
                    ffl6 = 0
                    ffl20 = 0
                    if ffl9 == 1:
                         ffl22 = 1
                    if enfl == 1:
                         ffl6 = 0
                         ffl27 = 0			

               if ffls3 == 1 and tanbu1 == 3:           
                    if ffls2 == 0:
                         ffl20 = 0
                    ffl5 = 0
                    ffl20 = 0
                    if ffl10 == 1:
                         ffl21 = 1
                    if each == 0:
                         ffl7 = 0
                         ffl27 = 0
             
               ffl16 = '右端部'
               ffl17 = 1
               ffl18 = '右端部'
               ffl19 = 1

               if ffl8z == 2:
                    ffl8 = 1
                    ffl8z = 0

               if waku == waku000 or waku == waku001:
                    if ewaku < l06:
                         if cfl == 1:
                              ffl16 = 'L'
                              ffl17 = chouseix + (chouseixx * (chouseix == 0)) + (chouseixxx * (chouseix * chouseixx == 0)) + tokuteijyouken2
                              ffl18 = 'セットバック長さ'
                              ffl19 = chouseix * (chouseix <> chouseixx) + tokuteijyouken2
                              ffl8z = 1
                         else:
                              ffl16 = 'L'
                              ffl17 = chouseix + (chouseixx * (chouseix == 0)) + (chouseixxx * (chouseix * chouseixx == 0)) + tokuteijyouken2
                              ffl18 = 'セットバック長さ'
                              ffl19 = chouseix * (chouseix <> chouseixx) + tokuteijyouken2
                              ffl8z = 1
                    else:
                         if cfl == 1:
                              ffl16 = 'L'
                              ffl17 = chouseix + (chouseixx * (chouseix == 0)) + (chouseixxx * (chouseix * chouseixx == 0)) + tokuteijyouken2
                              ffl18 = 'セットバック長さ'
                              ffl19 = chouseix * (chouseix <> chouseixx) + tokuteijyouken2
                              ffl8z = 1
                         else:
                              ffl16 = 'L'
                              ffl17 = chouseix + (chouseixx * (chouseix == 0)) + (chouseixxx * (chouseix * chouseixx == 0)) + tokuteijyouken2
                              ffl18 = 'セットバック長さ'
                              ffl19 = chouseix * (chouseix <> chouseixx) + tokuteijyouken2
                              ffl8z = 1
                              
                    if ffl17 <= lcc:
                         ffl5 = 0
                    if tokuteij3 > 0:
                         ffl16 = 'L'
                         ffl17 = tokuteij3
                         ffl18 = 'セットバック長さ'
                         ffl19 = tokuteij3
                         ffl8z = 1
                         ffl5 = 1
                         if sheetflg2 == 0 and ffls2 == 1:
                              ffl5 = 0
               if ffl8z == 1:
                    ffl8z = ffl8z + 1

               ffl23 = 1
               ffl24 = 1
               ffl25 = 1
               ffl26 = 1
               if habaki <= 0:
                    ffl23 = 0
                    ffl24 = 0
                    ffl25 = 0
                    ffl26 = 0
               if habaki == 1:
                    pass
               if habaki == 2:
                    ffl23 = 0
                    ffl24 = 1
                    ffl25 = ( ffl7 == 0 )
                    ffl26 = ( ffl6 == 0 )
                    if ffls2 == 1 and sheetselect2 > 0:
                         ffl25 = ffl25 * ( ffls7 == 0 )
                         ffl26 = ffl26 * ( ffls6 == 0 )
                         ffl26 = (ffls6 == 1) * (tanbu2 == 3)
               if habaki >= 3:
                    ffl23 = 1
                    ffl24 = 0
                    ffl25 = ( ffls7 == 1 )
                    ffl26 = ( ffls6 == 1 )

               if zsaijoudan == 0 and ffl1 ==1:
                    ffl1 = 0
               if zsaikadan == 0:
                    ffl2 = 0
               if setuzoku1 == 1 and saisyonogyou == 1:
                    ffl8 = 0
                    ffl7 = 0
                    ffl3 = 0
                    ffl25 = 0
               if ( each + 1 ) >= (loopcnt - 0) and warikiri ==2:
                    ffl29 = 1
                    if arubatorosu == 1:
                         ffl29 = 0
               if ( each + 2 ) >= (loopcnt - 0) and c00 > 0 and jidou == 1 and jsyuuten == 0:
                    ffl29 = 1
                    if arubatorosu == 1: 
                         ffl29 = 0
               if ( each + 2 ) == (loopcnt - 0) and c00 > 0 and jidou == 1 and jsyuuten == 1:
                    ffl29 = 1
                    if arubatorosu == 1: 
                         ffl29 = 0
               if ( each + 1 ) == (loopcnt - 0) and c00 > 0 and jidou == 1 and jsyuuten == 1:
                    ffl8 = 1

               ffl5 = (ffl5 == 1) * sheetselect
               ffl6 = (ffl6 == 1) * sheetselect2
               ffl7 = (ffl7 == 1) * sheetselect2

               ffl34 = 0
               if (iqashiba == 1 or arubatorosu == 1) * (saisyonogyou == 1) * (ffl20 == 1) * (ffl13 == 1) > 0:
                    ffl8 = 0
                    ffl34 = 1
                    if ffl1 == 1:
                         ffl34 = 0
               ffl35 = 0
               if (iqashiba == 1) * (saisyonogyou == 1) * (ffl20 == 0) * (ffl2 == 1) * (ffl13 == 1) > 0:
                    ffl35 = 1

               lastl = 0
               if ( each + 1 ) == ( loopcnt - 1 ) and each <> 0 and ewakufl <> 0:
                    lastl = 1
               if ( each + 1 ) == ( loopcnt - 2 ) and chousei2 <> 0 and each <> 0 and ewakufl == 2:
                    lastl = 1
               if cfl == 1 and ( each + 1 ) == ( bwakus - 0 + 2 ) and chousei3 <> 0 and ewakufl == 2:
                    lastl = 1
               if ( each + 1 ) == ( loopcnt - 0 ) and each <> 0 and ewakufl == 0:
                    lastl = 1
               ffl40 = 0

               if ( (iqashiba == 1) * (lastl == 1) * (supanchouseifl == 0) * ( ((esbk == wakuhaba)*(tanbu2 == 0)) or ((esbk == 0)*(tanbu2 == 0)) ) ) > 0:
                    ffl40 = 1

               if ffl8 == 1 and kyouseisc == 1:
                    ffl28 = 1
               if ffl8 == 1 and kyouseisn == 1 and each == 0:
                    ffl8 = 0

               if ( each + 2 ) >= (loopcnt - 0) and kyouseiec == 1:
                    ffl29 = 1
                    ffl17 = ffl17 + lcc
                    ffl19 = ffl19 + lcc
                    if arubatorosu == 1: 
                         ffl29 = 0
               if (lastl == 1) * (kyouseien == 1) > 0:
                    ffl40 = 2

               ffl5 = ffl5 + (3*(ffl5 == 3)*(sheetname == 1))
               ffl6 = ffl6 + (3*(ffl6 == 3)*(sheetname == 1))
               ffl7 = ffl7 + (3*(ffl7 == 3)*(sheetname == 1))
     
               list0.append(x)
               list1.append(y)
               list2.append(z)
               list3.append(waku)
               list4.append(vvvvv)
               list5.append(ffl1)
               list6.append(ffl2)
               list7.append(ffl3)
               list8.append(ffl4)
               list9.append(ffl5)
               list10.append(ffl6)
               list11.append(ffl7)
               list12.append(ffl8)
               list13.append(ffl9)
               list14.append(ffl10)
               list15.append(ffl11)
               list16.append(ffl12)
               list17.append(ffl13)
               list18.append(ffl14)
               list19.append(ffl15)
               list20.append(ffl16)
               list21.append(ffl17)
               list22.append(ffl18)
               list23.append(ffl19)
               list24.append(ffl20)
               list25.append(ffl21)
               list26.append(ffl22)
               list27.append(ffl23)
               list28.append(ffl24)
               list29.append(ffl25)
               list30.append(ffl26)
               list31.append(ffl27)
               list32.append(ffl28)
               list33.append(ffl29)
               list34.append(ffl34)
               list35.append(ffl35)
               list36.append(ffl36)
               list37.append(ffl37)
               list38.append(ffl38)
               list39.append(ffl39)
               list40.append(ffl40)

          waku = b1waku
          each += 1
     each = strc
     peach += 1

OUT =[list0,list1,list2,list3,list4,list5,list6,list7,list8,list9,list10,list11,list12,list13,list14,list15,list16,list17,list18,list19,list20,list21,list22,list23,list24,list25,list26,list27,list28,list29,list30,list31,list32,list33,list34,list35,list36,list37,list38,list39,list40]

###end
# ----------------------------------------
処理内容 = Watch(python_script)
code_block = CodeBlock(list=処理内容)
# ---------- code_block.designscript (41 lines) ----------
list[0];
list[1];
list[2];
list[3];
list[4];
list[5];
list[6];
list[7];
list[8];
list[9];
list[10];
list[11];
list[12];
list[13];
list[14];
list[15];
list[16];
list[17];
list[18];
list[19];
list[20];
list[21];
list[22];
list[23];
list[24];
list[25];
list[26];
list[27];
list[28];
list[29];
list[30];
list[31];
list[32];
list[33];
list[34];
list[35];
list[36];
list[37];
list[38];
list[39];
list[40];
# ----------------------------------------
byCoordinates_2 = Point.ByCoordinates(x=code_block.out0, y=code_block.out1, z=code_block.out2)
byPoint = FamilyInstance.ByPoint(familyType=code_block.out3, point=byCoordinates_2)
setRotation = FamilyInstance.SetRotation(familyInstance=byPoint, degree=code_block.out4)
python_script_2 = Python(IN[0]=code_block.out4)
# ---------- python_script_2.python (32 lines) ----------
#======================================================================
#Project Name    : 仮設BIM効率化システム
#File Name       : 01BIM[Ver表記]仮設BIM効率化システム.dyn
#Encoding        : 該当なし
#Creation Date   : 2019.12.5～2020.08.04以降随時
 
#Copyright © 2019.12.5 HIROYA MIZUMOTO. All rights reserved.
 
#This source code or any portion thereof must not be  
#reproduced or used in any manner whatsoever.
#======================================================================
## Python のサポートを有効にして DesignScript ライブラリをロード
#import clr
#clr.AddReference('ProtoGeometry')
#from Autodesk.DesignScript.Geometry import *
## Import RevitNodes
#clr.AddReference("RevitNodes")
#import Revit
## Import Revit elements
#from Revit.Elements import *
## Import DocumentManager
#clr.AddReference("RevitServices")
#import RevitServices
#from RevitServices.Persistence import DocumentManager
#import System
#import math
## このノードへの入力は、リスト形式で IN 変数に格納されます。
dataEnteringNode = IN
a = []
a = IN[0]
b = len(a)
OUT = [b]
# ----------------------------------------
code_block_2 = CodeBlock(a1=code_block.out5, a2=code_block.out6, a3=code_block.out7, a4=code_block.out8, a5=code_block.out9, a6=code_block.out10, a7=code_block.out11, a8=code_block.out12, a9=code_block.out13, a10=code_block.out14, a11=code_block.out15, a12=code_block.out16, a13=code_block.out17, a14=code_block.out18, a15=code_block.out19, a16=code_block.out20, a17=code_block.out21, a18=code_block.out22, a19=code_block.out23, a20=code_block.out24, a21=code_block.out25, a22=code_block.out26, a23=code_block.out27, a24=code_block.out28, a25=code_block.out29, a26=code_block.out30, a27=code_block.out31, a28=code_block.out32, a29=code_block.out33, a30=code_block.out34, a31=code_block.out35, a32=code_block.out36, a33=code_block.out37, a34=code_block.out38, a35=code_block.out39, a36=code_block.out40, f=setRotation, z=python_script_2)
# ---------- code_block_2.designscript (249 lines) ----------
a1[];
a2[];
a3[];
a4[];
a5[];
a6[];
a7[];
a8[];
a9[];
a10[];
a11[];
a12[];
a13[];
a14[];
a15[];
a16[];
a17[];
a18[];
a19[];
a20[];
a21[];
a22[];
a23[];
a24[];
a25[];
a26[];
a27[];
a28[];
a29[];
a30[];
a31[];
a32[];
a33[];
a34[];
a35[];
a36[];
f[];
z[];
[Imperative]
{
y = z[0];
range = 0..y;
    for(i in range)
    {
        if((a23[i] == 1) && (a20[i] == 1)){Element.SetParameterByName(f[i],"外側幅木",1);
        }
        if(a1[i] == 0){;
        }
        else{Element.SetParameterByName(f[i],"最上段",1);
            if(a27[i] == 0){Element.SetParameterByName(f[i],"外側頭つなぎ",0);
            }
        }
        if(a2[i] == 0){;
        }
        else{Element.SetParameterByName(f[i],"最下段",1);
            if(a26[i] == 0){Element.SetParameterByName(f[i],"妻幅木右",0);
            }
            if(a25[i] == 0){Element.SetParameterByName(f[i],"妻幅木左",0);
            }
        }
        if(a3[i] == 0){;
        }
        else{Element.SetParameterByName(f[i],"妻手摺左",1);
        }
        if(a4[i] == 0){;
        }
        else{Element.SetParameterByName(f[i],"妻手摺右",1);
        }
        if(a5[i] == 1){;
        }
        elseif(a5[i] == 2){Element.SetParameterByName(f[i],"垂直ネット",1);
        Element.SetParameterByName(f[i],"メッシュシート",0);
        }
        elseif(a5[i] == 3){Element.SetParameterByName(f[i],"防炎シート 1類",1);
        Element.SetParameterByName(f[i],"メッシュシート",0);
        }
        elseif(a5[i] == 4){Element.SetParameterByName(f[i],"防音シート",1);
        Element.SetParameterByName(f[i],"メッシュシート",0);
        }
        elseif(a5[i] == 5){Element.SetParameterByName(f[i],"防音パネル",1);
        Element.SetParameterByName(f[i],"メッシュシート",0);
        }
        elseif(a5[i] == 6){Element.SetParameterByName(f[i],"防炎シート",1);
        Element.SetParameterByName(f[i],"メッシュシート",0);
        }
        elseif(a5[i] == 0){Element.SetParameterByName(f[i],"シート",0);
        }
        else{;
        }
        if(a6[i] ==0){;
        }
        elseif(a6[i] == 1){Element.SetParameterByName(f[i],"シート右",1);
        }
        elseif(a6[i] == 2){Element.SetParameterByName(f[i],"妻側 垂直ネット",1);
        Element.SetParameterByName(f[i],"妻側 メッシュシート",0);
        Element.SetParameterByName(f[i],"シート右",1);
        }
        elseif(a6[i] == 3){Element.SetParameterByName(f[i],"妻側 防炎シート 1類",1);
        Element.SetParameterByName(f[i],"妻側 メッシュシート",0);
        Element.SetParameterByName(f[i],"シート右",1);
        }
        elseif(a6[i] == 4){Element.SetParameterByName(f[i],"妻側 防音シート",1);
        Element.SetParameterByName(f[i],"妻側 メッシュシート",0);
        Element.SetParameterByName(f[i],"シート右",1);
        }
        elseif(a6[i] == 5){Element.SetParameterByName(f[i],"妻側 防音パネル",1);
        Element.SetParameterByName(f[i],"妻側 メッシュシート",0);
        Element.SetParameterByName(f[i],"シート右",1);
        }
        elseif(a6[i] == 6){Element.SetParameterByName(f[i],"妻側 防炎シート",1);
        Element.SetParameterByName(f[i],"妻側 メッシュシート",0);
        Element.SetParameterByName(f[i],"シート右",1);
        }
        else{;
        }
        if(a7[i] == 0){;
        }
        elseif(a7[i] == 1){Element.SetParameterByName(f[i],"シート左",1);
        }
        elseif(a7[i] == 2){Element.SetParameterByName(f[i],"妻側 垂直ネット",1);
        Element.SetParameterByName(f[i],"妻側 メッシュシート",0);
        Element.SetParameterByName(f[i],"シート左",1);
        }
        elseif(a7[i] == 3){Element.SetParameterByName(f[i],"妻側 防炎シート 1類",1);
        Element.SetParameterByName(f[i],"妻側 メッシュシート",0);
        Element.SetParameterByName(f[i],"シート左",1);
        }
        elseif(a7[i] == 4){Element.SetParameterByName(f[i],"妻側 防音シート",1);
        Element.SetParameterByName(f[i],"妻側 メッシュシート",0);
        Element.SetParameterByName(f[i],"シート左",1);
        }
        elseif(a7[i] == 5){Element.SetParameterByName(f[i],"妻側 防音パネル",1);
        Element.SetParameterByName(f[i],"妻側 メッシュシート",0);
        Element.SetParameterByName(f[i],"シート左",1);
        }
        elseif(a7[i] == 6){Element.SetParameterByName(f[i],"妻側 防炎シート",1);
        Element.SetParameterByName(f[i],"妻側 メッシュシート",0);
        Element.SetParameterByName(f[i],"シート左",1);
        }
        else{;
        }
        if(a8[i] == 0){;
        }
        else{Element.SetParameterByName(f[i],"左端部",1);
        }
        if(a9[i] == 0){;
        }
        else{Element.SetParameterByName(f[i],"ブラケット右",1);
        }
        if(a10[i] == 0){;
        }
        else{Element.SetParameterByName(f[i],"ブラケット左",1);
        }
        if(a11[i] == 0){;
        }
        else{Element.SetParameterByName(f[i],"落下防止棚",1);
        }
        if(a12[i] == 0){;
        }
        else{Element.SetParameterByName(f[i],"壁つなぎ右",1);
        }
        if(a13[i] > 0){;
        }
        else{Element.SetParameterByName(f[i],"内側筋違い",0);
        Element.SetParameterByName(f[i],"内側幅木",0);
        }
        if(a14[i] == 0){;
        }
        else{Element.SetParameterByName(f[i],"妻手摺左",1);
        if(a25[i] == 0){Element.SetParameterByName(f[i],"妻幅木左",0);
        }
        }
        if(a15[i] == 0){;
        }
        else{Element.SetParameterByName(f[i],"妻手摺右",1);
        if(a26[i] == 0){Element.SetParameterByName(f[i],"妻幅木右",0);
        }
        }
        if(a16[i] == "L"){Element.SetParameterByName(f[i],"L",a17[i]);
        }
        if(a18[i] == "セットバック長さ"){Element.SetParameterByName(f[i],"セットバック長さ",a19[i]);
        }
        if(a20[i] == 0){Element.SetParameterByName(f[i],"外側筋違い",0);
        Element.SetParameterByName(f[i],"外側幅木",0);
        }
        if(a21[i] > 0){Element.SetParameterByName(f[i],"左ブラケット外",1);
        Element.SetParameterByName(f[i],"左ブラケット内",1);
        Element.SetParameterByName(f[i],"左落下防止棚",1);
        }
        if(a22[i] > 0){Element.SetParameterByName(f[i],"右ブラケット外",1);
        Element.SetParameterByName(f[i],"右ブラケット内",1);
        Element.SetParameterByName(f[i],"右落下防止棚",1);
        }
        //if(a23[i] == 1){Element.SetParameterByName(f[i],"外側幅木",1);
        //}
        if(a24[i] == 0){Element.SetParameterByName(f[i],"内側幅木",0);
        }
        if(a28[i] > 0){Element.SetParameterByName(f[i],"隙間ステップ左内",1);
        Element.SetParameterByName(f[i],"隙間ステップ左外",1);
        Element.SetParameterByName(f[i],"自在左内",1);
        Element.SetParameterByName(f[i],"自在左外",1);
        }
        if(a29[i] > 0){Element.SetParameterByName(f[i],"隙間ステップ右内",1);
        Element.SetParameterByName(f[i],"隙間ステップ右外",1);
        Element.SetParameterByName(f[i],"自在右内",1);
        Element.SetParameterByName(f[i],"自在右外",1);
        }
        if(a30[i] == 0){;
        }
        else{Element.SetParameterByName(f[i],"左梁間方向水平材強制表示",1);
        }
        if(a31[i] == 0){;
        }
        else{Element.SetParameterByName(f[i],"妻幅木左",1);
        }
        if(a32[i] == 0){;
        }
        else{Element.SetParameterByName(f[i],"内側根がらみ外に移動",1);
        }
        if(a33[i] == 0){;
        }
        else{Element.SetParameterByName(f[i],"外側頭つなぎ内に移動",1);
        }
        if((a9[i]+a10[i]+a21[i]+a22[i]) == 0){;
        }
        elseif(a34[i] == 300){;
        }
        else{Element.SetParameterByName(f[i],"ブラケット張出長さ",a34[i]);
        	if(a21[i] > 0){Element.SetParameterByName(f[i],"左ブラケット張出長さ",a34[i]);
        	}
        	if(a22[i] > 0){Element.SetParameterByName(f[i],"右ブラケット張出長さ",a34[i]);
        	}
        }
        if(a12[i] == 0){;
        }
        elseif(a35[i] == 300){;
        }
        else{Element.SetParameterByName(f[i],"壁つなぎ右長さ",a35[i]);
        }
        if(a36[i] == 0){;
        }
        elseif(a36[i] == 1){
        Element.SetParameterByName(f[i],"右端部",0);
        Element.SetParameterByName(f[i],"右梁間方向水平材強制表示",1);
        }
        else{Element.SetParameterByName(f[i],"右端部",0);
        }
    }
};
# ----------------------------------------
stringInput = StringInput("------ここから(自動)パラメータ設定------")  # graph input
stringInput_2 = StringInput("------ここから(共通)パラメータ設定------")  # graph input
stringInput_3 = StringInput("------ここから(手動)パラメータ設定------")  # graph input
stringInput_4 = StringInput("------ここから(共通)パラメータ設定------")  # graph input
stringInput_5 = StringInput("------ここから(共通)ファミリ入替え設定------")  # graph input
